# Grasshopper definition 7-21_work.gh (Grasshopper 0.9.75)

number_slider = Slider(10, range=0..100)
line = Line(Line((25, 0, 0), (25, 5, 0)))
int = Integer(1)
X = UnitX(Factor=Slider(0.25, range=0..1))
sdivide = DivideSurface(Surface=<geometry referenced from the Rhino model>, UCount=number_slider, VCount=Slider(7, range=0..100))  # -> Points, Normals, Parameters
viewer = ParamViewer(sdivide.Points)
addition = Addition(A=number_slider, B=int)
move = Move(Geometry=line, Motion=X)  # -> Geometry, Transform
series = Series(Start=0, Step=1, Count=10)
series_2 = Series(Start=0, Step=addition, Count=11)
rotate = Rotate(Geometry=move.Geometry, Angle=1.570796327, Plane=PlaneXY(0, 0, 0))  # -> Geometry, Transform
intcrv = Interpolate(Vertices=sdivide.Points, Degree=3, Periodic=False, KnotStyle=1)  # -> Curve, Length, Domain
rotate_2 = Rotate(Angle=1.570796327, Plane=PlaneXY(0, 0, 0))  # -> Geometry, Transform
X_2 = UnitX(Factor=series_2)
split = SplitTree()  # -> Positive, Negative
panel = Panel(X_2)
move_2 = Move(Geometry=intcrv.Curve, Motion=X_2)  # -> Geometry, Transform
path_mapper = PathMapper()
panel_2 = Panel(intcrv.Curve)
srfgrid = SurfaceFromPoints(Interpolate=False)
sdivide_2 = DivideSurface(Surface=<geometry referenced from the Rhino model>, UCount=10, VCount=10)  # -> Points, Normals, Parameters
split_2 = SplitTree(Data=sdivide_2.Points, Masks=flatten("{0;0;1 or 2}"))  # -> Positive, Negative
points = PointList(Points=split_2.Positive, Size=0.5)
viewer_2 = ParamViewer(sdivide_2.Points)
