# Grasshopper definition testing out stuff.gh (Grasshopper 0.9.75)

crv = Curve(<curve referenced from the Rhino model>)
crv_2 = Curve(<curve referenced from the Rhino model>)
ln = Line(StartPoint=<geometry referenced from the Rhino model>, EndPoint=<geometry referenced from the Rhino model>)
Z = UnitZ(Factor=Slider(5, range=0..10))
ln_2 = Line(StartPoint=<geometry referenced from the Rhino model>, EndPoint=<geometry referenced from the Rhino model>)
Z_2 = UnitZ(Factor=Slider(5, range=0..10))
move = Move(Geometry=crv, Motion=Z)  # -> Geometry, Transform
crv_3 = Curve(<curve referenced from the Rhino model>)
move_2 = Move(Geometry=crv_2, Motion=Z_2)  # -> Geometry, Transform
crv_4 = Curve(<curve referenced from the Rhino model>)
end = EndPoints(Curve=crv_3)  # -> Start, End
end_2 = EndPoints(Curve=move.Geometry)  # -> Start, End
end_3 = EndPoints(Curve=crv_4)  # -> Start, End
end_4 = EndPoints(Curve=move_2.Geometry)  # -> Start, End
ln_3 = Line(StartPoint=end.Start, EndPoint=end_2.End)
ln_4 = Line(StartPoint=end.End, EndPoint=end_2.Start)
ln_5 = Line(StartPoint=end_3.Start, EndPoint=end_4.End)
ln_6 = Line(StartPoint=end_3.End, EndPoint=end_4.Start)
edgesrf = EdgeSurface(CurveA=ln_3, CurveB=ln_4)
netsurf = NetworkSurface(CurvesU=[ln_3, ln_4], CurvesV=[crv_3, move.Geometry], Continuity=0)
edgesrf_2 = EdgeSurface(CurveA=ln_5, CurveB=ln_6)
planesrf = PlaneSurface(Plane=PlaneXY(-0.5, -0.5, 0), XSize=Domain(0, 10), YSize=Domain(0, 10))
srf4pt = _4PointSurface()
netsurf_2 = NetworkSurface(CurvesU=[ln_5, ln_6], CurvesV=[crv_4, move_2.Geometry], Continuity=0)
planesrf_2 = PlaneSurface(Plane=PlaneXY(-0.5, -0.5, 0), XSize=Domain(0, 10), YSize=Domain(0, 10))
srf4pt_2 = _4PointSurface()
Z_3 = UnitZ(Factor=1)
Z_4 = UnitZ(Factor=1)
move_3 = Move(Geometry=planesrf, Motion=Z_3)  # -> Geometry, Transform
move_4 = Move(Geometry=planesrf_2, Motion=Z_4)  # -> Geometry, Transform
sunion = SolidUnion(Breps=[edgesrf, netsurf])
move_5 = Move(Geometry=move_3.Geometry, Motion=Z_3)  # -> Geometry, Transform
edges = BrepEdges(Brep=netsurf_2)  # -> Naked, Interior, NonManifold
move_6 = Move(Geometry=move_4.Geometry, Motion=Z_4)  # -> Geometry, Transform
panel = Panel(edges.Naked)
split = SplitBrep(Brep=sunion, Cutter=[move_5.Geometry, move_3.Geometry])
branch = TreeBranch(Tree=edges.Naked, Path="{1}", MaintainPaths=True)
Y = UnitY(Factor=Slider(11, range=0..30))
bang = ExplodeTree(Data=edges.Naked)  # -> Branch0, Branch1
move_7 = Move(Geometry=split, Motion=Y)  # -> Geometry, Transform
gate = StreamGate(Stream=bang.Branch0, Gate=0)  # -> Target0, Target1, Target2
debrep = DeconstructBrep(Brep=move_7.Geometry)  # -> Faces, Edges, Vertices
brep = Brep()
explode = Explode(Recursive=True)  # -> Segments, Vertices
explode_2 = Explode(Recursive=True)  # -> Segments, Vertices
Y_2 = UnitY(Factor=Slider(11, range=0..30))
move_8 = Move(Geometry=debrep.Edges, Motion=Y_2)  # -> Geometry, Transform
simplify = SimplifyTree(Tree=move_8.Geometry, Front=False)
