# Grasshopper definition 2am_hollowcenter.gh (Grasshopper 0.9.75)

number_slider = Slider(25, range=-50..50)
neg = Negative(Value=number_slider)
brep = Brep(<brep referenced from the Rhino model>)
dom = ConstructDomain(DomainStart=neg, DomainEnd=number_slider)
planesrf = PlaneSurface(Plane=PlaneXY(0, 0, 0), XSize=dom, YSize=dom)
series = Series(Start=Slider(0, range=0..8), Step=Slider(1, range=0..8), Count=Slider(4, range=0..8))
Z = UnitZ(Factor=series)
number_slider_2 = Slider(25, range=0..50)
move = Move(Geometry=planesrf, Motion=Z)  # -> Geometry, Transform
sec = BrepPlane(Brep=brep, Plane=move.Geometry)  # -> Curves, Points
series_2 = Series(Start=Slider(1, range=0..8), Step=Slider(1, range=0..8), Count=Slider(2, range=0..8))
item = ListItem(List=sec.Curves, Index=series_2, Wrap=True)
viewer = ParamViewer(item)
brep_2 = Brep(item)
X = UnitX(Factor=Slider(20, range=0..20))
move_2 = Move(Geometry=brep_2, Motion=X)  # -> graft(Geometry), Transform
split = SplitTree(Data=move_2.Geometry, Masks=flatten("{0;0;?;0}"))  # -> Positive, Negative
viewer_2 = ParamViewer(move_2.Geometry)
debrep = DeconstructBrep(Brep=move_2.Geometry)  # -> Faces, Edges, Vertices
rdiff = RegionDifference(CurvesA=split.Positive, CurvesB=split.Negative)
X_2 = UnitX(Factor=Slider(20, range=0..20))
item_2 = ListItem(List=debrep.Faces, Index=Slider(2, range=0..4), Wrap=True)
move_3 = Move(Geometry=rdiff, Motion=X_2)  # -> Geometry, Transform
srf = Surface(item_2)
X_3 = UnitX(Factor=Slider(20, range=0..20))
move_4 = Move(Geometry=srf, Motion=X_3)  # -> simplify(graft(Geometry)), Transform
panel = Panel(move_4.Geometry)
number_slider_3 = Slider(0, range=0..8)
series_3 = Series(Start=Slider(0, range=0..8), Step=Slider(1, range=0..8), Count=number_slider_3)
item_3 = ListItem(List=move_4.Geometry, Index=number_slider_3, Wrap=True)
