# Grasshopper definition balls along curves.gh (Grasshopper 0.9.75)

contour = Contour(Curve=<geometry referenced from the Rhino model>, Point=Point(-19, 18, 0), Direction=Vector(-19, 18, 0), Distance=0.5)  # -> Contours, Parameters
srf = Surface(<surface referenced from the Rhino model>)
number_slider = Slider(5, range=0..50)
srf_2 = Surface(<surface referenced from the Rhino model>)
srf_3 = Surface(<surface referenced from the Rhino model>)
sdivide = DivideSurface(Surface=srf, UCount=Slider(9, range=0..50), VCount=Slider(10, range=0..50))  # -> Points, Normals, Parameters
number_slider_2 = Slider(3, range=0..50)
srf_4 = Surface(<surface referenced from the Rhino model>)
srf_5 = Surface(<surface referenced from the Rhino model>)
pl = PlaneNormal(Origin=sdivide.Points, ZAxis=sdivide.Normals)
sph = Sphere(Base=PlaneXY(0, 0, 0), Radius=1)
srf_6 = Surface(<surface referenced from the Rhino model>)
deplane = DeconstructPlane(Plane=pl)  # -> Origin, XAxis, YAxis, ZAxis
sdivide_2 = DivideSurface(Surface=srf_5, UCount=Slider(11, range=0..50), VCount=Slider(10, range=0..50))  # -> simplify(Points), Normals, Parameters
sph_2 = Sphere(Base=PlaneXY(0, 0, 0), Radius=1)
ellipse = Ellipse(Plane=pl, Radius1=number_slider, Radius2=number_slider_2)  # -> Ellipse, Focus1, Focus2
X = UnitX(Factor=1)
line = LineSDL(Start=deplane.Origin, Direction=deplane.XAxis, Length=1)
volume = Volume(Geometry=sph_2)  # -> Volume, Centroid
viewer = ParamViewer(sdivide_2.Points)
ellipse_2 = Ellipse(Plane=PlaneXY(0, 0, 0), Radius1=number_slider, Radius2=number_slider_2)  # -> Ellipse, Focus1, Focus2
revsrf = Revolution(Curve=ellipse.Ellipse, Axis=line, Domain=Domain(0, 6.283185307))  # -> simplify(Surface)
intcrv = Interpolate(Vertices=sdivide_2.Points, Degree=3, Periodic=False, KnotStyle=1)  # -> Curve, Length, Domain
volume_2 = Volume(Geometry=sph)  # -> Volume, Centroid
sdivide_3 = DivideSurface(Surface=srf_6, UCount=Slider(9, range=0..50), VCount=Slider(6, range=0..50))  # -> simplify(Points), Normals, Parameters
line_2 = LineSDL(Start=X, Direction=X, Length=1)
vec2pt = Vector2Pt(PointA=volume.Centroid, PointB=sdivide_3.Points, Unitize=False)  # -> Vector, Length
divide = DivideCurve(Curve=intcrv.Curve, Count=10, Kinks=False)  # -> Points, Tangents, Parameters
revsrf_2 = Revolution(Curve=ellipse_2.Ellipse, Axis=line_2, Domain=Domain(0, 6.283185307))
vec2pt_2 = Vector2Pt(PointA=divide.Points, PointB=volume_2.Centroid, Unitize=False)  # -> Vector, Length
move = Move(Geometry=sph_2, Motion=vec2pt.Vector)  # -> flatten(Geometry), Transform
sdiff = SolidDifference(BrepsA=revsrf_2)
move_2 = Move(Geometry=sph, Motion=vec2pt_2.Vector)  # -> Geometry, Transform
brep = Brep(<brep referenced from the Rhino model>)
X_2 = UnitX(Factor=Slider(9, range=0..50))
move_3 = Move(Geometry=sdiff, Motion=X_2)  # -> Geometry, Transform
sdiff_2 = SolidDifference(BrepsA=brep, BrepsB=move.Geometry)
X_3 = UnitX(Factor=Slider(13, range=0..50))
move_4 = Move(Geometry=sdiff_2, Motion=X_3)  # -> Geometry, Transform
brep_2 = Brep(<brep referenced from the Rhino model>)
brep_3 = Brep(<brep referenced from the Rhino model>)
sdiff_3 = SolidDifference(BrepsB=brep_2)
X_4 = UnitX(Factor=Slider(9, range=0..50))
move_5 = Move(Geometry=sdiff_3, Motion=X_4)  # -> Geometry, Transform
sdiff_4 = SolidDifference(BrepsA=brep_3, BrepsB=move_5.Geometry)
