# Grasshopper definition combination algorithms.gh (Grasshopper 0.9.75)

crv = Curve()
crv_2 = Curve()
contour = Contour(Curve=<geometry referenced from the Rhino model>, Point=Point(-19, 18, 0), Direction=Vector(-19, 18, 0), Distance=0.5)  # -> Contours, Parameters
sph = Sphere(Base=PlaneXY(0, 0, 0), Radius=1)
srf = Surface(<surface referenced from the Rhino model>)
srf_2 = Surface(<surface referenced from the Rhino model>)
srf_3 = Surface(<surface referenced from the Rhino model>)
number_slider = Slider(5, range=0..50)
srf_4 = Surface(<surface referenced from the Rhino model>)
srf_5 = Surface(<surface referenced from the Rhino model>)
sdivide = DivideSurface(Surface=srf_2, UCount=Slider(9, range=0..50), VCount=Slider(10, range=0..50))  # -> Points, Normals, Parameters
number_slider_2 = Slider(3, range=0..50)
srf_6 = Surface(<surface referenced from the Rhino model>)
sph_2 = Sphere(Base=PlaneXY(0, 0, 0), Radius=1)
srfpt = SurfacePoints(Surface=sph)  # -> Points, Weights, Greville, UCount, VCount
number_slider_3 = Slider(16, range=0..50)
volume = Volume(Geometry=sph)  # -> Volume, Centroid
srf_7 = Surface(<surface referenced from the Rhino model>)
number_slider_4 = Slider(16, range=0..50)
pl = PlaneNormal(Origin=sdivide.Points, ZAxis=sdivide.Normals)
volume_2 = Volume(Geometry=sph_2)  # -> Volume, Centroid
sdivide_2 = DivideSurface(Surface=srf, UCount=Slider(23, range=0..50), VCount=Slider(19, range=0..50))  # -> simplify(Points), Normals, Parameters
sdivide_3 = DivideSurface(Surface=srf_3, UCount=Slider(23, range=0..50), VCount=Slider(19, range=0..50))  # -> simplify(Points), Normals, Parameters
sph_3 = Sphere(Base=PlaneXY(0, 0, 0), Radius=1)
neg = Negative(Value=number_slider_3)
neg_2 = Negative(Value=number_slider_4)
vec2pt = Vector2Pt(PointA=volume.Centroid, PointB=sdivide_2.Points, Unitize=False)  # -> Vector, Length
deplane = DeconstructPlane(Plane=pl)  # -> Origin, XAxis, YAxis, ZAxis
vec2pt_2 = Vector2Pt(PointA=volume_2.Centroid, PointB=sdivide_3.Points, Unitize=False)  # -> Vector, Length
sdivide_4 = DivideSurface(Surface=srf_7, UCount=Slider(11, range=0..50), VCount=Slider(10, range=0..50))  # -> simplify(Points), Normals, Parameters
ellipse = Ellipse(Plane=pl, Radius1=number_slider, Radius2=number_slider_2)  # -> Ellipse, Focus1, Focus2
dom = ConstructDomain(DomainStart=neg, DomainEnd=number_slider_3)
dom_2 = ConstructDomain(DomainStart=neg_2, DomainEnd=number_slider_4)
X = UnitX(Factor=1)
line = LineSDL(Start=deplane.Origin, Direction=deplane.XAxis, Length=1)
viewer = ParamViewer(sdivide_4.Points)
series = Series(Start=Slider(6, range=0..50), Step=Slider(4, range=0..50), Count=Slider(3, range=0..50))
move = Move(Geometry=sph, Motion=vec2pt.Vector)  # -> flatten(Geometry), Transform
ellipse_2 = Ellipse(Plane=PlaneXY(0, 0, 0), Radius1=number_slider, Radius2=number_slider_2)  # -> Ellipse, Focus1, Focus2
series_2 = Series(Start=Slider(6, range=0..50), Step=Slider(4, range=0..50), Count=Slider(3, range=0..50))
move_2 = Move(Geometry=sph_2, Motion=vec2pt_2.Vector)  # -> flatten(Geometry), Transform
revsrf = Revolution(Curve=ellipse.Ellipse, Axis=line, Domain=Domain(0, 6.283185307))  # -> simplify(Surface)
intcrv = Interpolate(Vertices=sdivide_4.Points, Degree=3, Periodic=False, KnotStyle=1)  # -> Curve, Length, Domain
volume_3 = Volume(Geometry=sph_3)  # -> Volume, Centroid
planesrf = PlaneSurface(Plane=PlaneXY(0, 0, 0), XSize=dom, YSize=dom)
planesrf_2 = PlaneSurface(Plane=PlaneXY(0, 0, 0), XSize=dom_2, YSize=dom_2)
brep = Brep(<brep referenced from the Rhino model>)
line_2 = LineSDL(Start=X, Direction=X, Length=1)
brep_2 = Brep(<brep referenced from the Rhino model>)
X_2 = UnitX(Factor=Slider(13, range=0..50))
Z = UnitZ(Factor=series)
Z_2 = UnitZ(Factor=series_2)
divide = DivideCurve(Curve=intcrv.Curve, Count=10, Kinks=False)  # -> Points, Tangents, Parameters
move_3 = Move(Motion=X_2)  # -> Geometry, Transform
revsrf_2 = Revolution(Curve=ellipse_2.Ellipse, Axis=line_2, Domain=Domain(0, 6.283185307))
sdiff = SolidDifference(BrepsA=brep, BrepsB=move.Geometry)
sdiff_2 = SolidDifference(BrepsA=brep_2, BrepsB=move_2.Geometry)
vec2pt_3 = Vector2Pt(PointA=divide.Points, PointB=volume_3.Centroid, Unitize=False)  # -> Vector, Length
move_4 = Move(Geometry=planesrf, Motion=Z)  # -> Geometry, Transform
move_5 = Move(Geometry=planesrf_2, Motion=Z_2)  # -> Geometry, Transform
number_slider_5 = Slider(1, range=0..50)
sdiff_3 = SolidDifference(BrepsA=revsrf_2)
sec = BrepPlane(Brep=sdiff, Plane=move_4.Geometry)  # -> Curves, Points
number_slider_6 = Slider(1, range=0..50)
sec_2 = BrepPlane(Brep=sdiff_2, Plane=move_5.Geometry)  # -> Curves, Points
move_6 = Move(Geometry=sph_3, Motion=vec2pt_3.Vector)  # -> Geometry, Transform
X_3 = UnitX(Factor=Slider(9, range=0..50))
move_7 = Move(Geometry=sdiff_3, Motion=X_3)  # -> Geometry, Transform
item = ListItem(List=sec.Curves, Index=number_slider_5, Wrap=True)
item_2 = ListItem(List=sec_2.Curves, Index=number_slider_6, Wrap=True)
series_3 = Series(Start=Slider(0, range=0..50), Step=Slider(1, range=0..50), Count=number_slider_5)
series_4 = Series(Start=Slider(0, range=0..50), Step=Slider(1, range=0..50), Count=number_slider_6)
brep_3 = Brep(item)
brep_4 = Brep(item_2)
brep_5 = Brep(<brep referenced from the Rhino model>)
brep_6 = Brep(<brep referenced from the Rhino model>)
X_4 = UnitX(Factor=Slider(20, range=0..50))
X_5 = UnitX(Factor=Slider(20, range=0..50))
sdiff_4 = SolidDifference(BrepsB=brep_5)
move_8 = Move(Geometry=brep_3, Motion=X_4)  # -> Geometry, Transform
move_9 = Move(Geometry=brep_4, Motion=X_5)  # -> Geometry, Transform
X_6 = UnitX(Factor=Slider(9, range=0..50))
move_10 = Move(Geometry=sdiff_4, Motion=X_6)  # -> Geometry, Transform
sdiff_5 = SolidDifference(BrepsA=brep_6, BrepsB=move_10.Geometry)
