# Grasshopper definition ellipsoids_on_surface.gh (Grasshopper 0.9.75)

srf = Surface(<surface referenced from the Rhino model>)
number_slider = Slider(3, range=0..50)
number_slider_2 = Slider(1, range=0..50)
srf_2 = Surface(<surface referenced from the Rhino model>)
srf_3 = Surface(<surface referenced from the Rhino model>)
sdivide = DivideSurface(Surface=srf, UCount=Slider(2, range=0..50), VCount=Slider(2, range=0..50))  # -> Points, Normals, Parameters
srf_4 = Surface(<surface referenced from the Rhino model>)
pl = PlaneNormal(Origin=sdivide.Points, ZAxis=sdivide.Normals)
deplane = DeconstructPlane(Plane=pl)  # -> Origin, XAxis, YAxis, ZAxis
ellipse = Ellipse(Plane=pl, Radius1=number_slider, Radius2=number_slider_2)  # -> Ellipse, Focus1, Focus2
X = UnitX(Factor=1)
line = LineSDL(Start=deplane.Origin, Direction=deplane.XAxis, Length=1)
ellipse_2 = Ellipse(Plane=PlaneXY(0, 0, 0), Radius1=number_slider, Radius2=number_slider_2)  # -> Ellipse, Focus1, Focus2
revsrf = Revolution(Curve=ellipse.Ellipse, Axis=line, Domain=Domain(0, 6.283185307))  # -> simplify(Surface)
line_2 = LineSDL(Start=X, Direction=X, Length=1)
revsrf_2 = Revolution(Curve=ellipse_2.Ellipse, Axis=line_2, Domain=Domain(0, 6.283185307))
brep = Brep(<brep referenced from the Rhino model>)
brep_2 = Brep(<brep referenced from the Rhino model>)
sdiff = SolidDifference(BrepsA=revsrf_2)
sdiff_2 = SolidDifference(BrepsA=brep, BrepsB=brep_2)
X_2 = UnitX(Factor=Slider(9, range=0..50))
move = Move(Geometry=sdiff, Motion=X_2)  # -> Geometry, Transform
brep_3 = Brep(<brep referenced from the Rhino model>)
X_3 = UnitX(Factor=Slider(9, range=0..50))
move_2 = Move(Geometry=sdiff_2, Motion=X_3)  # -> Geometry, Transform
sdiff_3 = SolidDifference(BrepsA=brep_3, BrepsB=move_2.Geometry)
X_4 = UnitX(Factor=Slider(13, range=0..50))
move_3 = Move(Geometry=sdiff_3, Motion=X_4)  # -> Geometry, Transform
