# Grasshopper definition bookshelf design [Aug-13 '14, 0215].gh (Grasshopper 0.9.75)

number_slider = Slider(2, range=0..100)
number_slider_2 = Slider(10, range=0..100)
number_slider_3 = Slider(23, range=0..100)
number_slider_4 = Slider(0.25, range=0..1)
dom = ConstructDomain(DomainStart=Slider(1.1, range=0..10), DomainEnd=Slider(10, range=0..10))
dom_2 = ConstructDomain(DomainStart=Slider(1, range=0..1), DomainEnd=Slider(1.428, range=0..5))
number_slider_5 = Slider(18, range=0..100)
addition = Addition(A=Slider(3, range=0..20))
crv = Curve(<curve referenced from the Rhino model>)
divide = DivideCurve(Curve=crv, Count=10, Kinks=False)  # -> Points, Tangents, Parameters
plfit = PlaneFit(Points=divide.Points)  # -> Plane, Deviation
trim = TrimWithRegion()  # -> Inside, Outside
random = Random(Range=dom, Number=number_slider_5, Seed=2)  # -> flatten(Random)
boundary = BoundarySurfaces(Edges=crv)
random_2 = Random(Range=dom_2, Number=number_slider_5, Seed=addition)  # -> flatten(Random)
popgeo = PopulateGeometry(Geometry=boundary, Count=number_slider_5, Seed=1)
pdecon = Deconstruct(Point=popgeo)  # -> XComponent, YComponent, ZComponent
vec = VectorXYZ(XComponent=pdecon.XComponent, YComponent=pdecon.YComponent, ZComponent=pdecon.ZComponent)  # -> Vector, Length
dom_3 = ConstructDomain(DomainStart=Slider(-0.625, range=-1..1), DomainEnd=Slider(1.855, range=0..5))
X = UnitX(Factor=random)
random_3 = Random(Range=dom_3, Number=number_slider_5, Seed=2)  # -> flatten(Random)
random_4 = Random(Range=dom_3, Number=number_slider_5, Seed=4)  # -> flatten(Random)
move = Move(Geometry=popgeo, Motion=X)  # -> Geometry, Transform
Y = UnitY(Factor=random_3)
Y_2 = UnitY(Factor=random_4)
ellipse = Ellipse(Plane=flatten(popgeo), Radius1=random, Radius2=random_2)  # -> Ellipse, Focus1, Focus2
multiplication = Multiplication(A=Y_2, B=-1)
trim_2 = TrimWithBrep()  # -> Inside, Outside
move_2 = Move(Geometry=move.Geometry, Motion=flatten(Y))  # -> Geometry, Transform
rint = RegionIntersection()
multiplication_2 = Multiplication(A=X, B=-2)
move_3 = Move(Geometry=move.Geometry, Motion=multiplication_2)  # -> Geometry, Transform
move_4 = Move(Geometry=move_3.Geometry, Motion=flatten(multiplication))  # -> Geometry, Transform
ln = Line(StartPoint=move_2.Geometry, EndPoint=move_4.Geometry)
line = Line()
srfsplit = SurfaceSplit(Surface=ellipse.Ellipse, Curves=ln)  # -> graft(Fragments)
split = SplitTree(Data=srfsplit, Masks=flatten("{0;0;1,2,...;0}"))  # -> Positive, Negative
srf = Surface(split.Negative)
rdiff = RegionDifference(CurvesA=crv, CurvesB=split.Positive)
