# Grasshopper definition bookshelf design.gh (Grasshopper 0.9.75)

number_slider = Slider(2, range=0..100)
number_slider_2 = Slider(10, range=0..100)
number_slider_3 = Slider(0.25, range=0..1)
number_slider_4 = Slider(23, range=0..100)
dom = ConstructDomain(DomainStart=Slider(1.1, range=0..10), DomainEnd=Slider(10, range=0..10))
dom_2 = ConstructDomain(DomainStart=Slider(1, range=0..1), DomainEnd=Slider(1.428, range=0..5))
number_slider_5 = Slider(18, range=0..100)
addition = Addition(A=Slider(3, range=0..20))
random = Random(Range=dom_2, Number=number_slider_5, Seed=addition)  # -> flatten(Random)
random_2 = Random(Range=dom, Number=number_slider_5, Seed=2)  # -> flatten(Random)
crv = Curve(<curve referenced from the Rhino model>)
boundary = BoundarySurfaces(Edges=crv)
popgeo = PopulateGeometry(Geometry=boundary, Count=number_slider_5, Seed=1)
divide = DivideCurve(Curve=crv, Count=10, Kinks=False)  # -> Points, Tangents, Parameters
dom_3 = ConstructDomain(DomainStart=Slider(-0.625, range=-1..1), DomainEnd=Slider(1.855, range=0..5))
plfit = PlaneFit(Points=divide.Points)  # -> Plane, Deviation
X = UnitX(Factor=random_2)
random_3 = Random(Range=dom_3, Number=number_slider_5, Seed=2)  # -> flatten(Random)
random_4 = Random(Range=dom_3, Number=number_slider_5, Seed=4)  # -> flatten(Random)
move = Move(Geometry=popgeo, Motion=X)  # -> Geometry, Transform
Y = UnitY(Factor=random_3)
Y_2 = UnitY(Factor=random_4)
ellipse = Ellipse(Plane=flatten(popgeo), Radius1=random_2, Radius2=random)  # -> Ellipse, Focus1, Focus2
multiplication = Multiplication(A=Y_2, B=-1)
move_2 = Move(Geometry=move.Geometry, Motion=flatten(Y))  # -> Geometry, Transform
multiplication_2 = Multiplication(A=X, B=-2)
move_3 = Move(Geometry=move.Geometry, Motion=multiplication_2)  # -> Geometry, Transform
move_4 = Move(Geometry=move_3.Geometry, Motion=flatten(multiplication))  # -> Geometry, Transform
ln = Line(StartPoint=move_2.Geometry, EndPoint=move_4.Geometry)
reduce = RandomReduce(List=ellipse.Ellipse, Reduction=Slider(7, range=0..100), Seed=1)
srfsplit = SurfaceSplit(Surface=reduce, Curves=ln)  # -> graft(Fragments)
split = SplitTree(Data=srfsplit, Masks=flatten("{0;0;1,2,...;0}"))  # -> Positive, Negative
rdiff = RegionDifference(CurvesA=crv, CurvesB=split.Negative)
