# Grasshopper definition bookshelf design_7pm.gh (Grasshopper 0.9.75)

number_slider = Slider(2, range=0..100)
number_slider_2 = Slider(10, range=0..100)
number_slider_3 = Slider(0.25, range=0..1)
number_slider_4 = Slider(23, range=0..100)
# create random semi major/minor axes
dom = ConstructDomain(DomainStart=Slider(1.1, range=0..10), DomainEnd=Slider(10, range=0..10))
dom_2 = ConstructDomain(DomainStart=Slider(1, range=0..1), DomainEnd=Slider(1.428, range=0..5))
number_slider_5 = Slider(18, range=0..100)
addition = Addition(A=Slider(3, range=0..20))
panel = Panel("reference geometry")
random = Random(Range=dom_2, Number=number_slider_5, Seed=addition)  # -> flatten(Random)
random_2 = Random(Range=dom, Number=number_slider_5, Seed=2)  # -> flatten(Random)
crv = Curve(<curve referenced from the Rhino model>)
boundary = BoundarySurfaces(Edges=crv)
# populate geometry with random points
popgeo = PopulateGeometry(Geometry=boundary, Count=number_slider_5, Seed=1)
divide = DivideCurve(Curve=crv, Count=10, Kinks=False)  # -> Points, Tangents, Parameters
dom_3 = ConstructDomain(DomainStart=Slider(-0.625, range=-1..1), DomainEnd=Slider(1.855, range=0..5))
plfit = PlaneFit(Points=divide.Points)  # -> Plane, Deviation
X = UnitX(Factor=random_2)
random_3 = Random(Range=dom_3, Number=number_slider_5, Seed=2)  # -> flatten(Random)
random_4 = Random(Range=dom_3, Number=number_slider_5, Seed=4)  # -> flatten(Random)
panel_2 = Panel("generate random lines")
move = Move(Geometry=popgeo, Motion=X)  # -> Geometry, Transform
Y = UnitY(Factor=random_3)
Y_2 = UnitY(Factor=random_4)
panel_3 = Panel("generate ellipses")
ellipse = Ellipse(Plane=flatten(popgeo), Radius1=random_2, Radius2=random)  # -> Ellipse, Focus1, Focus2
multiplication = Multiplication(A=Y_2, B=-1)
move_2 = Move(Geometry=move.Geometry, Motion=flatten(Y))  # -> Geometry, Transform
multiplication_2 = Multiplication(A=X, B=-2)
move_3 = Move(Geometry=move.Geometry, Motion=multiplication_2)  # -> Geometry, Transform
move_4 = Move(Geometry=move_3.Geometry, Motion=flatten(multiplication))  # -> Geometry, Transform
ln = Line(StartPoint=move_2.Geometry, EndPoint=move_4.Geometry)  # -> simplify(Line)
number_slider_6 = Slider(14, range=0..100)
dom_4 = ConstructDomain(DomainStart=Slider(0, range=0..100), DomainEnd=number_slider_5)
panel_4 = Panel("11 ellipses multiply 19 seeds")
range = Range(Domain=dom_4, Steps=number_slider_5)
reduce = RandomReduce(List=ellipse.Ellipse, Reduction=Slider(7, range=0..100), Seed=range)  # -> simplify(List)
srfsplit = SurfaceSplit(Surface=reduce, Curves=ln)
split = SplitTree(Data=srfsplit, Masks=flatten("{0;0;1,2,...;0}"))  # -> Positive, Negative
number_slider_7 = Slider(50, range=0..1000)
item = ListItem(List=split.Negative, Index=Slider(1, range=0..1), Wrap=True)
series = Series(Start=number_slider_7, Step=number_slider_7, Count=Slider(18, range=0..100))
rdiff = RegionDifference(CurvesA=crv, CurvesB=item)  # -> simplify(Result)
X_2 = UnitX(Factor=series)
path_mapper = PathMapper(rdiff, source="{A;B}", target="{A}")
number_slider_8 = Slider(50, range=0..1000)
crv_2 = Curve(<curve referenced from the Rhino model>)
crv_3 = Curve(<curve referenced from the Rhino model>)
crv_4 = Curve(<curve referenced from the Rhino model>)
crv_5 = Curve(<curve referenced from the Rhino model>)
series_2 = Series(Start=number_slider_8, Step=number_slider_8, Count=Slider(18, range=0..100))
move_5 = Move(Geometry=crv_2, Motion=X_2)  # -> Geometry, Transform
X_3 = UnitX(Factor=series_2)
move_6 = Move(Geometry=crv_3, Motion=X_2)  # -> Geometry, Transform
move_7 = Move(Geometry=crv_4, Motion=X_2)  # -> Geometry, Transform
move_8 = Move(Geometry=crv_5, Motion=X_2)  # -> Geometry, Transform
move_9 = Move(Geometry=path_mapper, Motion=X_3)  # -> simplify(Geometry), Transform
panel_5 = Panel(move_9.Geometry)
