# Grasshopper definition design.gh (Grasshopper 0.9.75)

number_slider = Slider(2, range=0..100)
number_slider_2 = Slider(10, range=0..100)
number_slider_3 = Slider(23, range=0..100)
number_slider_4 = Slider(0.25, range=0..1)
dom = ConstructDomain(DomainStart=Slider(1, range=0..1), DomainEnd=Slider(5, range=0..5))
dom_2 = ConstructDomain(DomainStart=Slider(1, range=0..1), DomainEnd=Slider(1.428, range=0..5))
crv = Curve(<curve referenced from the Rhino model>)
divide = DivideCurve(Curve=crv, Count=10, Kinks=False)  # -> Points, Tangents, Parameters
plfit = PlaneFit(Points=divide.Points)  # -> Plane, Deviation
number_slider_5 = Slider(18, range=0..100)
addition = Addition(A=Slider(3, range=0..20))
trim = TrimWithRegion()  # -> Inside, Outside
random = Random(Range=dom, Number=number_slider_5, Seed=2)  # -> flatten(Random)
boundary = BoundarySurfaces(Edges=crv)
random_2 = Random(Range=dom_2, Number=number_slider_5, Seed=addition)  # -> flatten(Random)
popgeo = PopulateGeometry(Geometry=boundary, Count=number_slider_5, Seed=1)
viewer = ParamViewer(random)
pdecon = Deconstruct(Point=popgeo)  # -> XComponent, YComponent, ZComponent
gate = StreamGate(Stream=random, Gate=0)  # -> Target0, Target1
split = SplitTree()  # -> Positive, Negative
vec = VectorXYZ(XComponent=pdecon.XComponent, YComponent=pdecon.YComponent, ZComponent=pdecon.ZComponent)  # -> Vector, Length
item = TreeItem(Tree=random, Path="{0;0;>=4}", Index=0, Wrap=True)
ellipse = Ellipse(Plane=flatten(popgeo), Radius1=random, Radius2=random_2)  # -> Ellipse, Focus1, Focus2
panel = Panel(random)
path_mapper = PathMapper()
viewer_2 = ParamViewer(item)
gate_2 = StreamGate(Gate=0)  # -> Target0, Target1
area = Area(Geometry=ellipse.Ellipse)  # -> Area, Centroid
ccx = CurveCurve()  # -> Points, ParamsA, ParamsB
rdiff = RegionDifference(CurvesA=crv, CurvesB=ellipse.Ellipse)
