# Grasshopper definition 1023am.gh (Grasshopper 0.9.75)

# create random semi major/minor axes
dom = ConstructDomain(DomainStart=Slider(1.1, range=0..10), DomainEnd=Slider(18.202, range=0..30))
# create random semi major/minor axes
dom_2 = ConstructDomain(DomainStart=Slider(1.1, range=0..10), DomainEnd=Slider(18.202, range=0..30))
dom_3 = ConstructDomain(DomainStart=Slider(1, range=0..1), DomainEnd=Slider(5, range=0..10))
dom_4 = ConstructDomain(DomainStart=Slider(1, range=0..1), DomainEnd=Slider(5, range=0..10))
addition = Addition(A=Slider(3, range=0..20))
panel = Panel("reference geometry")
addition_2 = Addition(A=Slider(3, range=0..20))
boundary = BoundarySurfaces()
boundary_2 = BoundarySurfaces()
dom_5 = ConstructDomain(DomainStart=Slider(-0.625, range=-1..1), DomainEnd=Slider(1.855, range=0..5))
number_slider = Slider(50, range=0..1000)
dom_6 = ConstructDomain(DomainStart=Slider(-0.625, range=-1..1), DomainEnd=Slider(1.855, range=0..5))
series = Series(Start=number_slider, Step=number_slider, Count=Slider(70, range=0..100))
panel_3 = Panel("generate random lines")
X = UnitX(Factor=series)
panel_6 = Panel("generate ellipses")
crv = Curve(<curve referenced from the Rhino model>)
crv_2 = Curve(<curve referenced from the Rhino model>)
crv_3 = Curve(<curve referenced from the Rhino model>)
crv_4 = Curve(<curve referenced from the Rhino model>)
move = Move(Geometry=crv, Motion=X)  # -> Geometry, Transform
move_2 = Move(Geometry=crv_3, Motion=X)  # -> Geometry, Transform
move_3 = Move(Geometry=crv_2, Motion=X)  # -> Geometry, Transform
move_4 = Move(Geometry=crv_4, Motion=X)  # -> Geometry, Transform
dom_7 = ConstructDomain(DomainStart=Slider(-0.625, range=-1..1), DomainEnd=Slider(1.855, range=0..5))
dom_8 = ConstructDomain(DomainStart=Slider(1.1, range=0..10), DomainEnd=Slider(20.386, range=0..30))
dom_9 = ConstructDomain(DomainStart=Slider(1, range=0..1), DomainEnd=Slider(5, range=0..10))
X_2 = UnitX(Factor=1)
# create random semi major/minor axes
number_slider_2 = Slider(17, range=0..100)
panel_8 = Panel("11 ellipses multiply 19 seeds")
random = Random(Range=dom_7, Number=1, Seed=2)  # -> flatten(Random)
addition_3 = Addition(A=Slider(3, range=0..20))
move_5 = Move(Geometry=X_2, Motion=X_2)  # -> Geometry, Transform
Y = UnitY(Factor=random)
Y_2 = UnitY(Factor=random)
random_2 = Random(Range=dom_9, Number=number_slider_2, Seed=addition_3)  # -> flatten(Random)
random_3 = Random(Range=dom_8, Number=number_slider_2, Seed=2)  # -> flatten(Random)
multiplication = Multiplication(A=Y_2, B=-1)
move_6 = Move(Geometry=move_5.Geometry, Motion=flatten(Y))  # -> Geometry, Transform
number_slider_3 = Slider(70, range=0..100)
random_4 = Random(Range=dom_3, Number=number_slider_3, Seed=addition)  # -> flatten(Random)
random_5 = Random(Range=dom, Number=number_slider_3, Seed=2)  # -> flatten(Random)
# populate geometry with random points
popgeo = PopulateGeometry(Geometry=boundary, Count=number_slider_3, Seed=1)
X_3 = UnitX(Factor=random_5)
random_6 = Random(Range=dom_5, Number=number_slider_3, Seed=2)  # -> flatten(Random)
random_7 = Random(Range=dom_5, Number=number_slider_3, Seed=4)  # -> flatten(Random)
move_7 = Move(Geometry=popgeo, Motion=X_3)  # -> Geometry, Transform
Y_3 = UnitY(Factor=random_6)
Y_4 = UnitY(Factor=random_7)
ellipse = Ellipse(Plane=flatten(popgeo), Radius1=random_5, Radius2=random_4)  # -> Ellipse, Focus1, Focus2
multiplication_2 = Multiplication(A=Y_4, B=-1)
move_8 = Move(Geometry=move_7.Geometry, Motion=flatten(Y_3))  # -> Geometry, Transform
multiplication_3 = Multiplication(A=X_3, B=-2)
move_9 = Move(Geometry=move_7.Geometry, Motion=multiplication_3)  # -> Geometry, Transform
move_10 = Move(Geometry=move_9.Geometry, Motion=flatten(multiplication_2))  # -> Geometry, Transform
subtraction = Subtraction(A=number_slider_3, B=Slider(5, range=0..10))
ln = Line(StartPoint=move_8.Geometry, EndPoint=move_10.Geometry)  # -> simplify(Line)
dom_10 = ConstructDomain(DomainStart=Slider(0, range=0..100), DomainEnd=number_slider_3)
range = Range(Domain=dom_10, Steps=number_slider_3)
reduce = RandomReduce(List=ellipse.Ellipse, Reduction=subtraction, Seed=range)  # -> simplify(List)
srfsplit = SurfaceSplit(Surface=reduce, Curves=ln)
split = SplitTree(Data=srfsplit, Masks=flatten("{0;0;1,2,...;0}"))  # -> Positive, Negative
number_slider_4 = Slider(70, range=0..100)
random_8 = Random(Range=dom_4, Number=number_slider_4, Seed=addition_2)  # -> flatten(Random)
random_9 = Random(Range=dom_2, Number=number_slider_4, Seed=2)  # -> flatten(Random)
# populate geometry with random points
popgeo_2 = PopulateGeometry(Geometry=boundary_2, Count=number_slider_4, Seed=1)
X_4 = UnitX(Factor=random_9)
random_10 = Random(Range=dom_6, Number=number_slider_4, Seed=2)  # -> flatten(Random)
random_11 = Random(Range=dom_6, Number=number_slider_4, Seed=4)  # -> flatten(Random)
move_11 = Move(Geometry=popgeo_2, Motion=X_4)  # -> Geometry, Transform
Y_5 = UnitY(Factor=random_10)
Y_6 = UnitY(Factor=random_11)
ellipse_2 = Ellipse(Plane=flatten(popgeo_2), Radius1=random_9, Radius2=random_8)  # -> Ellipse, Focus1, Focus2
multiplication_4 = Multiplication(A=Y_6, B=-1)
move_12 = Move(Geometry=move_11.Geometry, Motion=flatten(Y_5))  # -> Geometry, Transform
multiplication_5 = Multiplication(A=X_4, B=-2)
move_13 = Move(Geometry=move_11.Geometry, Motion=multiplication_5)  # -> Geometry, Transform
move_14 = Move(Geometry=move_13.Geometry, Motion=flatten(multiplication_4))  # -> Geometry, Transform
subtraction_2 = Subtraction(A=number_slider_4, B=Slider(5, range=0..10))
ln_2 = Line(StartPoint=move_12.Geometry, EndPoint=move_14.Geometry)  # -> simplify(Line)
dom_11 = ConstructDomain(DomainStart=Slider(0, range=0..100), DomainEnd=number_slider_4)
range_2 = Range(Domain=dom_11, Steps=number_slider_4)
reduce_2 = RandomReduce(List=ellipse_2.Ellipse, Reduction=subtraction_2, Seed=range_2)  # -> simplify(List)
srfsplit_2 = SurfaceSplit(Surface=reduce_2, Curves=ln_2)
split_2 = SplitTree(Data=srfsplit_2, Masks=flatten("{0;0;1,2,...;0}"))  # -> Positive, Negative
multiplication_6 = Multiplication(A=X_2, B=-2)
move_15 = Move(Geometry=move_5.Geometry, Motion=multiplication_6)  # -> Geometry, Transform
move_16 = Move(Geometry=move_15.Geometry, Motion=flatten(multiplication))  # -> Geometry, Transform
item = ListItem(List=split.Negative, Index=Slider(0, range=0..1), Wrap=True)
crv_5 = Curve(<curve referenced from the Rhino model>)
item_2 = ListItem(List=split_2.Negative, Index=Slider(1, range=0..1), Wrap=True)
ln_3 = Line(StartPoint=move_6.Geometry, EndPoint=move_16.Geometry)  # -> simplify(Line)
rdiff = RegionDifference(CurvesB=item)  # -> simplify(Result)
popgeo_3 = PopulateGeometry(Geometry=crv_5, Count=number_slider_2, Seed=Slider(22, range=0..100))
ellipse_3 = Ellipse(Plane=flatten(popgeo_3), Radius1=random_3, Radius2=random_2)  # -> Ellipse, Focus1, Focus2
rdiff_2 = RegionDifference(CurvesB=item_2)  # -> simplify(Result)
srfsplit_3 = SurfaceSplit(Curves=ln_3)
path_mapper = PathMapper(rdiff, source="{A;B}", target="{A}")
number_slider_5 = Slider(50, range=0..1000)
path_mapper_2 = PathMapper(rdiff_2, source="{A;B}", target="{A}")
number_slider_6 = Slider(50, range=0..1000)
series_2 = Series(Start=number_slider_5, Step=number_slider_5, Count=number_slider_3)
series_3 = Series(Start=number_slider_6, Step=number_slider_6, Count=number_slider_4)
X_5 = UnitX(Factor=series_2)
X_6 = UnitX(Factor=series_3)
move_17 = Move(Geometry=simplify(path_mapper), Motion=graft(X_5))  # -> simplify(Geometry), Transform
move_18 = Move(Geometry=simplify(path_mapper_2), Motion=graft(X_6))  # -> simplify(Geometry), Transform
panel_10 = Panel(move_17.Geometry)
panel_11 = Panel(move_18.Geometry)
