# Grasshopper definition bookshelf design_844pm.gh (Grasshopper 0.9.75)

# create random semi major/minor axes
dom = ConstructDomain(DomainStart=Slider(1.1, range=0..10), DomainEnd=Slider(18.202, range=0..30))
# create random semi major/minor axes
dom_2 = ConstructDomain(DomainStart=Slider(1.1, range=0..10), DomainEnd=Slider(18.202, range=0..30))
dom_3 = ConstructDomain(DomainStart=Slider(1, range=0..1), DomainEnd=Slider(5, range=0..10))
dom_4 = ConstructDomain(DomainStart=Slider(1, range=0..1), DomainEnd=Slider(5, range=0..10))
addition = Addition(A=Slider(3, range=0..20))
addition_2 = Addition(A=Slider(3, range=0..20))
panel = Panel("reference geometry")
dom_5 = ConstructDomain(DomainStart=Slider(-0.625, range=-1..1), DomainEnd=Slider(1.855, range=0..5))
number_slider = Slider(50, range=0..1000)
dom_6 = ConstructDomain(DomainStart=Slider(-0.625, range=-1..1), DomainEnd=Slider(1.855, range=0..5))
series = Series(Start=number_slider, Step=number_slider, Count=Slider(70, range=0..100))
panel_3 = Panel("generate random lines")
X = UnitX(Factor=series)
panel_5 = Panel("generate ellipses")
crv = Curve(<curve referenced from the Rhino model>)
crv_2 = Curve(<curve referenced from the Rhino model>)
crv_3 = Curve(<curve referenced from the Rhino model>)
crv_4 = Curve(<curve referenced from the Rhino model>)
move = Move(Geometry=crv, Motion=X)  # -> Geometry, Transform
move_2 = Move(Geometry=crv_3, Motion=X)  # -> Geometry, Transform
move_3 = Move(Geometry=crv_2, Motion=X)  # -> Geometry, Transform
move_4 = Move(Geometry=crv_4, Motion=X)  # -> Geometry, Transform
panel_7 = Panel("11 ellipses multiply 19 seeds")
crv_5 = Curve(<curve referenced from the Rhino model>)
boundary = BoundarySurfaces(Edges=crv_5)
number_slider_2 = Slider(70, range=0..100)
random = Random(Range=dom_3, Number=number_slider_2, Seed=addition)  # -> flatten(Random)
random_2 = Random(Range=dom, Number=number_slider_2, Seed=2)  # -> flatten(Random)
X_2 = UnitX(Factor=random_2)
random_3 = Random(Range=dom_5, Number=number_slider_2, Seed=2)  # -> flatten(Random)
random_4 = Random(Range=dom_5, Number=number_slider_2, Seed=4)  # -> flatten(Random)
Y = UnitY(Factor=random_3)
Y_2 = UnitY(Factor=random_4)
multiplication = Multiplication(A=Y_2, B=-1)
multiplication_2 = Multiplication(A=X_2, B=-2)
subtraction = Subtraction(A=number_slider_2, B=Slider(5, range=0..10))
dom_7 = ConstructDomain(DomainStart=Slider(0, range=0..100), DomainEnd=number_slider_2)
range = Range(Domain=dom_7, Steps=number_slider_2)
number_slider_3 = Slider(70, range=0..100)
random_5 = Random(Range=dom_4, Number=number_slider_3, Seed=addition_2)  # -> flatten(Random)
random_6 = Random(Range=dom_2, Number=number_slider_3, Seed=2)  # -> flatten(Random)
# populate geometry with random points
popgeo = PopulateGeometry(Geometry=boundary, Count=number_slider_3, Seed=1)
X_3 = UnitX(Factor=random_6)
random_7 = Random(Range=dom_6, Number=number_slider_3, Seed=2)  # -> flatten(Random)
random_8 = Random(Range=dom_6, Number=number_slider_3, Seed=4)  # -> flatten(Random)
move_5 = Move(Geometry=popgeo, Motion=X_3)  # -> Geometry, Transform
Y_3 = UnitY(Factor=random_7)
Y_4 = UnitY(Factor=random_8)
ellipse = Ellipse(Plane=flatten(popgeo), Radius1=random_6, Radius2=random_5)  # -> Ellipse, Focus1, Focus2
multiplication_3 = Multiplication(A=Y_4, B=-1)
move_6 = Move(Geometry=move_5.Geometry, Motion=flatten(Y_3))  # -> Geometry, Transform
multiplication_4 = Multiplication(A=X_3, B=-2)
move_7 = Move(Geometry=move_5.Geometry, Motion=multiplication_4)  # -> Geometry, Transform
move_8 = Move(Geometry=move_7.Geometry, Motion=flatten(multiplication_3))  # -> Geometry, Transform
subtraction_2 = Subtraction(A=number_slider_3, B=Slider(5, range=0..10))
ln = Line(StartPoint=move_6.Geometry, EndPoint=move_8.Geometry)  # -> simplify(Line)
dom_8 = ConstructDomain(DomainStart=Slider(0, range=0..100), DomainEnd=number_slider_3)
range_2 = Range(Domain=dom_8, Steps=number_slider_3)
reduce = RandomReduce(List=ellipse.Ellipse, Reduction=subtraction_2, Seed=range_2)  # -> simplify(List)
srfsplit = SurfaceSplit(Surface=reduce, Curves=ln)
split = SplitTree(Data=srfsplit, Masks=flatten("{0;0;1,2,...;0}"))  # -> Positive, Negative
crv_6 = Curve(<curve referenced from the Rhino model>)
boundary_2 = BoundarySurfaces(Edges=crv_6)
# populate geometry with random points
popgeo_2 = PopulateGeometry(Geometry=boundary_2, Count=number_slider_2, Seed=1)
move_9 = Move(Geometry=popgeo_2, Motion=X_2)  # -> Geometry, Transform
ellipse_2 = Ellipse(Plane=flatten(popgeo_2), Radius1=random_2, Radius2=random)  # -> Ellipse, Focus1, Focus2
move_10 = Move(Geometry=move_9.Geometry, Motion=flatten(Y))  # -> Geometry, Transform
move_11 = Move(Geometry=move_9.Geometry, Motion=multiplication_2)  # -> Geometry, Transform
move_12 = Move(Geometry=move_11.Geometry, Motion=flatten(multiplication))  # -> Geometry, Transform
ln_2 = Line(StartPoint=move_10.Geometry, EndPoint=move_12.Geometry)  # -> simplify(Line)
reduce_2 = RandomReduce(List=ellipse_2.Ellipse, Reduction=subtraction, Seed=range)  # -> simplify(List)
srfsplit_2 = SurfaceSplit(Surface=reduce_2, Curves=ln_2)
split_2 = SplitTree(Data=srfsplit_2, Masks=flatten("{0;0;1,2,...;0}"))  # -> Positive, Negative
item = ListItem(List=split_2.Negative, Index=Slider(0, range=0..1), Wrap=True)
item_2 = ListItem(List=split.Negative, Index=Slider(1, range=0..1), Wrap=True)
rdiff = RegionDifference(CurvesA=crv_6, CurvesB=item)  # -> simplify(Result)
rdiff_2 = RegionDifference(CurvesA=crv_5, CurvesB=item_2)  # -> simplify(Result)
path_mapper = PathMapper(rdiff, source="{A;B}", target="{A}")
number_slider_4 = Slider(50, range=0..1000)
path_mapper_2 = PathMapper(rdiff_2, source="{A;B}", target="{A}")
number_slider_5 = Slider(50, range=0..1000)
series_2 = Series(Start=number_slider_4, Step=number_slider_4, Count=number_slider_2)
series_3 = Series(Start=number_slider_5, Step=number_slider_5, Count=number_slider_3)
X_4 = UnitX(Factor=series_2)
X_5 = UnitX(Factor=series_3)
move_13 = Move(Geometry=simplify(path_mapper), Motion=graft(X_4))  # -> simplify(Geometry), Transform
move_14 = Move(Geometry=simplify(path_mapper_2), Motion=graft(X_5))  # -> simplify(Geometry), Transform
panel_9 = Panel(move_13.Geometry)
panel_10 = Panel(move_14.Geometry)
