# Grasshopper definition 1132.gh (Grasshopper 0.9.75)

# create random semi major/minor axes
dom = ConstructDomain(DomainStart=Slider(1.1, range=0..10), DomainEnd=Slider(18.202, range=0..30))
# create random semi major/minor axes
dom_2 = ConstructDomain(DomainStart=Slider(1.1, range=0..10), DomainEnd=Slider(18.202, range=0..30))
dom_3 = ConstructDomain(DomainStart=Slider(1, range=0..1), DomainEnd=Slider(5, range=0..10))
dom_4 = ConstructDomain(DomainStart=Slider(1, range=0..1), DomainEnd=Slider(5, range=0..10))
addition = Addition(A=Slider(3, range=0..20))
panel = Panel("reference geometry")
addition_2 = Addition(A=Slider(3, range=0..20))
random = Random(Range=dom_4, Number=1, Seed=addition_2)  # -> flatten(Random)
random_2 = Random(Range=dom_2, Number=1, Seed=2)  # -> flatten(Random)
boundary = BoundarySurfaces()
boundary_2 = BoundarySurfaces()
# populate geometry with random points
popgeo = PopulateGeometry(Geometry=boundary_2, Count=100, Seed=1)
dom_5 = ConstructDomain(DomainStart=Slider(-0.625, range=-1..1), DomainEnd=Slider(1.855, range=0..5))
number_slider = Slider(50, range=0..1000)
dom_6 = ConstructDomain(DomainStart=Slider(-0.625, range=-1..1), DomainEnd=Slider(1.855, range=0..5))
X = UnitX(Factor=random_2)
series = Series(Start=number_slider, Step=number_slider, Count=Slider(70, range=0..100))
random_3 = Random(Range=dom_6, Number=1, Seed=2)  # -> flatten(Random)
random_4 = Random(Range=dom_6, Number=1, Seed=4)  # -> flatten(Random)
panel_3 = Panel("generate random lines")
X_2 = UnitX(Factor=series)
move = Move(Geometry=popgeo, Motion=X)  # -> Geometry, Transform
dom_7 = ConstructDomain(DomainStart=Slider(1.1, range=0..10), DomainEnd=Slider(20.386, range=0..30))
dom_8 = ConstructDomain(DomainStart=Slider(1, range=0..1), DomainEnd=Slider(5, range=0..10))
Y = UnitY(Factor=random_3)
panel_5 = Panel("generate ellipses")
Y_2 = UnitY(Factor=random_4)
number_slider_2 = Slider(48, range=0..100)
ellipse = Ellipse(Plane=flatten(popgeo), Radius1=random_2, Radius2=random)  # -> Ellipse, Focus1, Focus2
multiplication = Multiplication(A=Y_2, B=-1)
move_2 = Move(Geometry=move.Geometry, Motion=flatten(Y))  # -> Geometry, Transform
crv = Curve(<curve referenced from the Rhino model>)
crv_2 = Curve(<curve referenced from the Rhino model>)
addition_3 = Addition(A=Slider(3, range=0..20))
crv_3 = Curve(<curve referenced from the Rhino model>)
crv_4 = Curve(<curve referenced from the Rhino model>)
multiplication_2 = Multiplication(A=X, B=-2)
move_3 = Move(Geometry=move.Geometry, Motion=multiplication_2)  # -> Geometry, Transform
random_5 = Random(Range=dom_8, Number=number_slider_2, Seed=addition_3)  # -> flatten(Random)
random_6 = Random(Range=dom_7, Number=number_slider_2, Seed=2)  # -> flatten(Random)
move_4 = Move(Geometry=crv, Motion=X_2)  # -> Geometry, Transform
move_5 = Move(Geometry=move_3.Geometry, Motion=flatten(multiplication))  # -> Geometry, Transform
move_6 = Move(Geometry=crv_3, Motion=X_2)  # -> Geometry, Transform
move_7 = Move(Geometry=crv_2, Motion=X_2)  # -> Geometry, Transform
move_8 = Move(Geometry=crv_4, Motion=X_2)  # -> Geometry, Transform
subtraction = Subtraction(B=Slider(5, range=0..10))
ln = Line(StartPoint=move_2.Geometry, EndPoint=move_5.Geometry)  # -> simplify(Line)
dom_9 = ConstructDomain(DomainStart=Slider(-0.625, range=-1..1), DomainEnd=Slider(1.855, range=0..5))
number_slider_3 = Slider(22, range=0..100)
dom_10 = ConstructDomain(DomainStart=Slider(1.1, range=0..10), DomainEnd=Slider(20.386, range=0..30))
dom_11 = ConstructDomain(DomainStart=Slider(1, range=0..1), DomainEnd=Slider(5, range=0..10))
crv_5 = Curve()
number_slider_4 = Slider(48, range=0..100)
dom_12 = ConstructDomain(DomainStart=Slider(0, range=0..100), DomainEnd=1)
number_slider_5 = Slider(22, range=0..100)
panel_7 = Panel("11 ellipses multiply 19 seeds")
number_slider_6 = Slider(50, range=0..1000)
random_7 = Random(Range=dom_9, Number=1, Seed=2)  # -> flatten(Random)
range = Range(Domain=dom_12, Steps=10)
addition_4 = Addition(A=Slider(3, range=0..20))
popgeo_2 = PopulateGeometry(Geometry=crv_5, Count=number_slider_3, Seed=number_slider_5)
Y_3 = UnitY(Factor=random_7)
ellipse_2 = Ellipse(Plane=flatten(popgeo_2), Radius1=random_6, Radius2=random_5)  # -> Ellipse, Focus1, Focus2
Y_4 = UnitY(Factor=random_7)
series_2 = Series(Start=number_slider_6, Step=number_slider_6, Count=Slider(70, range=0..100))
random_8 = Random(Range=dom_11, Number=number_slider_4, Seed=addition_4)  # -> flatten(Random)
random_9 = Random(Range=dom_10, Number=number_slider_4, Seed=2)  # -> flatten(Random)
X_3 = UnitX(Factor=random_9)
multiplication_3 = Multiplication(A=X_3, B=-2)
reduce = RandomReduce(List=ellipse.Ellipse, Reduction=subtraction, Seed=range)  # -> simplify(List)
X_4 = UnitX(Factor=series_2)
multiplication_4 = Multiplication(A=Y_4, B=-1)
srfsplit = SurfaceSplit(Surface=reduce, Curves=ln)
number_slider_7 = Slider(22, range=0..100)
split = SplitTree(Data=srfsplit, Masks=flatten("{0;0;1,2,...;0}"))  # -> Positive, Negative
number_slider_8 = Slider(70, range=0..100)
random_10 = Random(Range=dom_3, Number=number_slider_8, Seed=addition)  # -> flatten(Random)
random_11 = Random(Range=dom, Number=number_slider_8, Seed=2)  # -> flatten(Random)
# populate geometry with random points
popgeo_3 = PopulateGeometry(Geometry=boundary, Count=number_slider_8, Seed=1)
X_5 = UnitX(Factor=random_11)
random_12 = Random(Range=dom_5, Number=number_slider_8, Seed=2)  # -> flatten(Random)
random_13 = Random(Range=dom_5, Number=number_slider_8, Seed=4)  # -> flatten(Random)
move_9 = Move(Geometry=popgeo_3, Motion=X_5)  # -> Geometry, Transform
Y_5 = UnitY(Factor=random_12)
Y_6 = UnitY(Factor=random_13)
ellipse_3 = Ellipse(Plane=flatten(popgeo_3), Radius1=random_11, Radius2=random_10)  # -> Ellipse, Focus1, Focus2
multiplication_5 = Multiplication(A=Y_6, B=-1)
move_10 = Move(Geometry=move_9.Geometry, Motion=flatten(Y_5))  # -> Geometry, Transform
multiplication_6 = Multiplication(A=X_5, B=-2)
move_11 = Move(Geometry=move_9.Geometry, Motion=multiplication_6)  # -> Geometry, Transform
move_12 = Move(Geometry=move_11.Geometry, Motion=flatten(multiplication_5))  # -> Geometry, Transform
subtraction_2 = Subtraction(A=number_slider_8, B=Slider(5, range=0..10))
ln_2 = Line(StartPoint=move_10.Geometry, EndPoint=move_12.Geometry)  # -> simplify(Line)
dom_13 = ConstructDomain(DomainStart=Slider(0, range=0..100), DomainEnd=number_slider_8)
range_2 = Range(Domain=dom_13, Steps=number_slider_8)
reduce_2 = RandomReduce(List=ellipse_3.Ellipse, Reduction=subtraction_2, Seed=range_2)  # -> simplify(List)
srfsplit_2 = SurfaceSplit(Surface=reduce_2, Curves=ln_2)
split_2 = SplitTree(Data=srfsplit_2, Masks=flatten("{0;0;1,2,...;0}"))  # -> Positive, Negative
crv_6 = Curve()
subtraction_3 = Subtraction(A=number_slider_3, B=Slider(6, range=0..10))
item = ListItem(List=split_2.Negative, Index=Slider(0, range=0..1), Wrap=True)
item_2 = ListItem(List=split.Negative, Index=Slider(1, range=0..1), Wrap=True)
move_13 = Move(Motion=X_4)  # -> Geometry, Transform
dom_14 = ConstructDomain(DomainStart=number_slider_5, DomainEnd=number_slider_2)
range_3 = Range(Domain=dom_14, Steps=number_slider_5)
number_slider_9 = Slider(0, range=0..100)
rdiff = RegionDifference(CurvesB=item)  # -> simplify(Result)
popgeo_4 = PopulateGeometry(Geometry=crv_6, Count=number_slider_7, Seed=Slider(22, range=0..100))
move_14 = Move(Geometry=popgeo_4, Motion=X_3)  # -> Geometry, Transform
move_15 = Move(Geometry=move_14.Geometry, Motion=flatten(Y_3))  # -> Geometry, Transform
move_16 = Move(Geometry=move_14.Geometry, Motion=multiplication_3)  # -> Geometry, Transform
move_17 = Move(Geometry=move_16.Geometry, Motion=flatten(multiplication_4))  # -> Geometry, Transform
ln_3 = Line(StartPoint=move_15.Geometry, EndPoint=move_17.Geometry)  # -> simplify(Line)
ellipse_4 = Ellipse(Plane=flatten(popgeo_4), Radius1=random_9, Radius2=random_8)  # -> Ellipse, Focus1, Focus2
rdiff_2 = RegionDifference(CurvesB=item_2)  # -> simplify(Result)
path_mapper = PathMapper(rdiff, source="{A;B}", target="{A}")
number_slider_10 = Slider(50, range=0..1000)
path_mapper_2 = PathMapper(rdiff_2, source="{A;B}", target="{A}")
number_slider_11 = Slider(50, range=0..1000)
subtraction_4 = Subtraction(A=number_slider_7, B=Slider(6, range=0..10))
series_3 = Series(Start=number_slider_10, Step=number_slider_10, Count=number_slider_8)
series_4 = Series(Start=number_slider_11, Step=number_slider_11, Count=10)
reduce_3 = RandomReduce(List=ellipse_2.Ellipse, Reduction=subtraction_3, Seed=range_3)  # -> simplify(List)
X_6 = UnitX(Factor=series_3)
X_7 = UnitX(Factor=series_4)
move_18 = Move(Geometry=simplify(path_mapper), Motion=graft(X_6))  # -> simplify(Geometry), Transform
srfsplit_3 = SurfaceSplit(Surface=reduce_3)
move_19 = Move(Geometry=simplify(path_mapper_2), Motion=graft(X_7))  # -> simplify(Geometry), Transform
split_3 = SplitTree(Data=srfsplit_3, Masks=flatten("{0;0;1,2,...;0}"))  # -> Positive, Negative
dom_15 = ConstructDomain(DomainStart=Slider(0, range=0..100), DomainEnd=number_slider_4)
panel_11 = Panel(move_18.Geometry)
panel_12 = Panel(move_19.Geometry)
item_3 = ListItem(List=split_3.Negative, Index=Slider(1, range=0..1), Wrap=True)  # -> simplify(Item)
range_4 = Range(Domain=dom_15, Steps=number_slider_4)
reduce_4 = RandomReduce(List=ellipse_4.Ellipse, Reduction=subtraction_4, Seed=range_4)  # -> simplify(List)
path_mapper_3 = PathMapper(item_3, source="{A;B}", target="{A}")
number_slider_12 = Slider(50, range=0..1000)
srfsplit_4 = SurfaceSplit(Surface=reduce_4, Curves=ln_3)
split_4 = SplitTree(Data=srfsplit_4, Masks=flatten("{0;0;1,2,...;0}"))  # -> Positive, Negative
series_5 = Series(Start=number_slider_12, Step=number_slider_12, Count=Slider(70, range=0..1000))
item_4 = ListItem(List=split_4.Negative, Index=Slider(1, range=0..1), Wrap=True)  # -> simplify(Item)
X_8 = UnitX(Factor=series_5)
move_20 = Move(Geometry=simplify(path_mapper_3), Motion=graft(X_8))  # -> simplify(Geometry), Transform
path_mapper_4 = PathMapper(item_4, source="{A;B}", target="{A}")
number_slider_13 = Slider(50, range=0..1000)
panel_13 = Panel(move_20.Geometry)
series_6 = Series(Start=number_slider_13, Step=number_slider_13, Count=Slider(70, range=0..1000))
X_9 = UnitX(Factor=series_6)
move_21 = Move(Geometry=simplify(path_mapper_4), Motion=graft(X_9))  # -> simplify(Geometry), Transform
panel_14 = Panel(move_21.Geometry)
