# Grasshopper definition 841pm.gh (Grasshopper 0.9.75)

# create random semi major/minor axes
dom = ConstructDomain(DomainStart=Slider(1.1, range=0..10), DomainEnd=Slider(18.202, range=0..30))
# create random semi major/minor axes
dom_2 = ConstructDomain(DomainStart=Slider(1.1, range=0..10), DomainEnd=Slider(18.202, range=0..30))
dom_3 = ConstructDomain(DomainStart=Slider(1, range=0..1), DomainEnd=Slider(5, range=0..10))
dom_4 = ConstructDomain(DomainStart=Slider(1, range=0..1), DomainEnd=Slider(5, range=0..10))
addition = Addition(A=Slider(3, range=0..20))
panel = Panel("reference geometry")
addition_2 = Addition(A=Slider(3, range=0..20))
random = Random(Range=dom_2, Number=1, Seed=2)  # -> flatten(Random)
random_2 = Random(Range=dom_4, Number=1, Seed=addition_2)  # -> flatten(Random)
boundary = BoundarySurfaces()
boundary_2 = BoundarySurfaces()
dom_5 = ConstructDomain(DomainStart=Slider(1.1, range=0..10), DomainEnd=Slider(20.386, range=0..30))
dom_6 = ConstructDomain(DomainStart=Slider(1, range=0..1), DomainEnd=Slider(5, range=0..10))
number_slider = Slider(3, range=0..20)
# populate geometry with random points
popgeo = PopulateGeometry(Geometry=boundary_2, Count=100, Seed=1)
number_slider_2 = Slider(48, range=0..100)
dom_7 = ConstructDomain(DomainStart=Slider(-0.625, range=-1..1), DomainEnd=Slider(1.855, range=0..5))
dom_8 = ConstructDomain(DomainStart=Slider(1.1, range=0..10), DomainEnd=Slider(20.386, range=0..30))
addition_3 = Addition(A=number_slider, B=Slider(3, range=0..20))
dom_9 = ConstructDomain(DomainStart=Slider(1, range=0..1), DomainEnd=Slider(5, range=0..10))
dom_10 = ConstructDomain(DomainStart=Slider(-0.625, range=-1..1), DomainEnd=Slider(1.855, range=0..5))
number_slider_3 = Slider(3, range=0..20)
random_3 = Random(Range=dom_6, Number=number_slider_2, Seed=addition_3)  # -> flatten(Random)
X = UnitX(Factor=random)
number_slider_4 = Slider(48, range=0..100)
number_slider_5 = Slider(12, range=0..100)
number_slider_6 = Slider(75, range=0..1000)
random_4 = Random(Range=dom_10, Number=1, Seed=2)  # -> flatten(Random)
number_slider_7 = Slider(75, range=0..1000)
random_5 = Random(Range=dom_10, Number=1, Seed=4)  # -> flatten(Random)
addition_4 = Addition(A=number_slider_3, B=Slider(3, range=0..20))
random_6 = Random(Range=dom_5, Number=number_slider_2, Seed=number_slider)  # -> flatten(Random)
panel_3 = Panel("generate random lines")
move = Move(Geometry=popgeo, Motion=X)  # -> Geometry, Transform
random_7 = Random(Range=dom_9, Number=number_slider_4, Seed=addition_4)  # -> flatten(Random)
random_8 = Random(Range=dom_8, Number=number_slider_4, Seed=number_slider_3)  # -> flatten(Random)
Y = UnitY(Factor=random_4)
panel_5 = Panel("generate ellipses")
Y_2 = UnitY(Factor=random_5)
ellipse = Ellipse(Plane=flatten(popgeo), Radius1=random, Radius2=random_2)  # -> Ellipse, Focus1, Focus2
crv = Curve(<curve referenced from the Rhino model>)
multiplication = Multiplication(A=Y_2, B=-1)
move_2 = Move(Geometry=move.Geometry, Motion=flatten(Y))  # -> Geometry, Transform
dom_11 = ConstructDomain(DomainStart=Slider(-0.625, range=-1..1), DomainEnd=Slider(1.855, range=0..5))
number_slider_8 = Slider(12, range=0..100)
multiplication_2 = Multiplication(A=X, B=-2)
move_3 = Move(Geometry=move.Geometry, Motion=multiplication_2)  # -> Geometry, Transform
popgeo_2 = PopulateGeometry(Geometry=crv, Count=number_slider_6, Seed=Slider(22, range=0..100))
crv_2 = Curve(<curve referenced from the Rhino model>)
move_4 = Move(Geometry=move_3.Geometry, Motion=flatten(multiplication))  # -> Geometry, Transform
X_2 = UnitX(Factor=random_8)
subtraction = Subtraction(B=Slider(5, range=0..10))
ln = Line(StartPoint=move_2.Geometry, EndPoint=move_4.Geometry)  # -> simplify(Line)
random_9 = Random(Range=dom_11, Number=1, Seed=2)  # -> flatten(Random)
ellipse_2 = Ellipse(Plane=flatten(popgeo_2), Radius1=random_6, Radius2=random_3)  # -> Ellipse, Focus1, Focus2
dom_12 = ConstructDomain(DomainStart=Slider(-0.625, range=-1..1), DomainEnd=Slider(1.855, range=0..5))
popgeo_3 = PopulateGeometry(Geometry=crv_2, Count=number_slider_7, Seed=Slider(22, range=0..100))
dom_13 = ConstructDomain(DomainStart=Slider(-0.625, range=-1..1), DomainEnd=Slider(1.855, range=0..5))
random_10 = Random(Range=dom_11, Number=1, Seed=4)  # -> flatten(Random)
dom_14 = ConstructDomain(DomainStart=Slider(1.1, range=0..10), DomainEnd=Slider(20.386, range=0..30))
dom_15 = ConstructDomain(DomainStart=Slider(1, range=0..1), DomainEnd=Slider(5, range=0..10))
X_3 = UnitX(Factor=random_6)
move_5 = Move(Geometry=popgeo_3, Motion=X_2)  # -> Geometry, Transform
number_slider_9 = Slider(48, range=0..100)
dom_16 = ConstructDomain(DomainStart=Slider(0, range=0..100), DomainEnd=1)
Y_3 = UnitY(Factor=random_9)
Y_4 = UnitY(Factor=random_10)
panel_7 = Panel("11 ellipses multiply 19 seeds")
dom_17 = ConstructDomain(DomainStart=0, DomainEnd=number_slider_6)
random_11 = Random(Range=dom_12, Number=1, Seed=2)  # -> flatten(Random)
random_12 = Random(Range=dom_13, Number=1, Seed=2)  # -> flatten(Random)
range = Range(Domain=dom_16, Steps=10)
random_13 = Random(Range=dom_12, Number=1, Seed=4)  # -> flatten(Random)
ellipse_3 = Ellipse(Plane=flatten(popgeo_3), Radius1=random_8, Radius2=random_7)  # -> Ellipse, Focus1, Focus2
range_2 = Range(Domain=dom_17, Steps=number_slider_6)
multiplication_3 = Multiplication(A=Y_4, B=-1)
move_6 = Move(Geometry=popgeo_2, Motion=X_3)  # -> Geometry, Transform
addition_5 = Addition(A=Slider(3, range=0..20))
subtraction_2 = Subtraction(A=number_slider_7, B=Slider(6, range=0..10))
subtraction_3 = Subtraction(A=number_slider_6, B=Slider(6, range=0..10))
Y_5 = UnitY(Factor=random_11)
Y_6 = UnitY(Factor=random_13)
Y_7 = UnitY(Factor=random_12)
move_7 = Move(Geometry=move_5.Geometry, Motion=flatten(Y_3))  # -> Geometry, Transform
Y_8 = UnitY(Factor=random_12)
random_14 = Random(Range=dom_15, Number=number_slider_9, Seed=addition_5)  # -> flatten(Random)
random_15 = Random(Range=dom_14, Number=number_slider_9, Seed=2)  # -> flatten(Random)
X_4 = UnitX(Factor=random_15)
multiplication_4 = Multiplication(A=X_4, B=-2)
reduce = RandomReduce(List=ellipse.Ellipse, Reduction=subtraction, Seed=range)  # -> simplify(List)
dom_18 = ConstructDomain(DomainStart=0, DomainEnd=number_slider_7)
multiplication_5 = Multiplication(A=X_2, B=-2)
move_8 = Move(Geometry=move_5.Geometry, Motion=multiplication_5)  # -> Geometry, Transform
multiplication_6 = Multiplication(A=Y_6, B=-1)
move_9 = Move(Geometry=move_8.Geometry, Motion=flatten(multiplication_3))  # -> Geometry, Transform
multiplication_7 = Multiplication(A=Y_8, B=-1)
srfsplit = SurfaceSplit(Surface=reduce, Curves=ln)
range_3 = Range(Domain=dom_18, Steps=number_slider_7)
move_10 = Move(Geometry=move_6.Geometry, Motion=flatten(Y_5))  # -> Geometry, Transform
ln_2 = Line(StartPoint=move_7.Geometry, EndPoint=move_9.Geometry)  # -> simplify(Line)
number_slider_10 = Slider(70, range=0..1000)
number_slider_11 = Slider(22, range=0..100)
split = SplitTree(Data=srfsplit, Masks=flatten("{0;0;1,2,...;0}"))  # -> Positive, Negative
number_slider_12 = Slider(70, range=0..100)
random_16 = Random(Range=dom_3, Number=number_slider_12, Seed=addition)  # -> flatten(Random)
random_17 = Random(Range=dom, Number=number_slider_12, Seed=2)  # -> flatten(Random)
# populate geometry with random points
popgeo_4 = PopulateGeometry(Geometry=boundary, Count=number_slider_12, Seed=1)
X_5 = UnitX(Factor=random_17)
random_18 = Random(Range=dom_7, Number=number_slider_12, Seed=2)  # -> flatten(Random)
random_19 = Random(Range=dom_7, Number=number_slider_12, Seed=4)  # -> flatten(Random)
move_11 = Move(Geometry=popgeo_4, Motion=X_5)  # -> Geometry, Transform
Y_9 = UnitY(Factor=random_18)
Y_10 = UnitY(Factor=random_19)
ellipse_4 = Ellipse(Plane=flatten(popgeo_4), Radius1=random_17, Radius2=random_16)  # -> Ellipse, Focus1, Focus2
multiplication_8 = Multiplication(A=Y_10, B=-1)
move_12 = Move(Geometry=move_11.Geometry, Motion=flatten(Y_9))  # -> Geometry, Transform
multiplication_9 = Multiplication(A=X_5, B=-2)
move_13 = Move(Geometry=move_11.Geometry, Motion=multiplication_9)  # -> Geometry, Transform
move_14 = Move(Geometry=move_13.Geometry, Motion=flatten(multiplication_8))  # -> Geometry, Transform
subtraction_4 = Subtraction(A=number_slider_12, B=Slider(5, range=0..10))
ln_3 = Line(StartPoint=move_12.Geometry, EndPoint=move_14.Geometry)  # -> simplify(Line)
dom_19 = ConstructDomain(DomainStart=Slider(0, range=0..100), DomainEnd=number_slider_12)
range_4 = Range(Domain=dom_19, Steps=number_slider_12)
reduce_2 = RandomReduce(List=ellipse_4.Ellipse, Reduction=subtraction_4, Seed=range_4)  # -> simplify(List)
srfsplit_2 = SurfaceSplit(Surface=reduce_2, Curves=ln_3)
split_2 = SplitTree(Data=srfsplit_2, Masks=flatten("{0;0;1,2,...;0}"))  # -> Positive, Negative
crv_3 = Curve()
multiplication_10 = Multiplication(A=X_3, B=-2)
move_15 = Move(Geometry=move_6.Geometry, Motion=multiplication_10)  # -> Geometry, Transform
move_16 = Move(Geometry=move_15.Geometry, Motion=flatten(multiplication_6))  # -> Geometry, Transform
item = ListItem(List=split_2.Negative, Index=Slider(0, range=0..1), Wrap=True)
reduce_3 = RandomReduce(List=ellipse_2.Ellipse, Reduction=subtraction_3, Seed=range_2)  # -> simplify(List)
item_2 = ListItem(List=split.Negative, Index=Slider(1, range=0..1), Wrap=True)
series = Series(Start=number_slider_10, Step=number_slider_10, Count=Slider(75, range=0..100))
ln_4 = Line(StartPoint=move_10.Geometry, EndPoint=move_16.Geometry)  # -> simplify(Line)
crv_4 = Curve([<curve referenced from the Rhino model> x6])
X_6 = UnitX(Factor=series)
rdiff = RegionDifference(CurvesB=item)  # -> simplify(Result)
popgeo_5 = PopulateGeometry(Geometry=crv_3, Count=number_slider_11, Seed=Slider(22, range=0..100))
move_17 = Move(Geometry=popgeo_5, Motion=X_4)  # -> Geometry, Transform
move_18 = Move(Geometry=move_17.Geometry, Motion=flatten(Y_7))  # -> Geometry, Transform
move_19 = Move(Geometry=move_17.Geometry, Motion=multiplication_4)  # -> Geometry, Transform
move_20 = Move(Geometry=move_19.Geometry, Motion=flatten(multiplication_7))  # -> Geometry, Transform
ln_5 = Line(StartPoint=move_18.Geometry, EndPoint=move_20.Geometry)  # -> simplify(Line)
ellipse_5 = Ellipse(Plane=flatten(popgeo_5), Radius1=random_15, Radius2=random_14)  # -> Ellipse, Focus1, Focus2
rdiff_2 = RegionDifference(CurvesB=item_2)  # -> simplify(Result)
group = Group(Objects=crv_4)
reduce_4 = RandomReduce(List=ellipse_3.Ellipse, Reduction=subtraction_2, Seed=range_3)  # -> simplify(List)
path_mapper = PathMapper(rdiff, source="{A;B}", target="{A}")
number_slider_13 = Slider(50, range=0..1000)
path_mapper_2 = PathMapper(rdiff_2, source="{A;B}", target="{A}")
move_21 = Move(Geometry=group, Motion=X_6)  # -> Geometry, Transform
number_slider_14 = Slider(50, range=0..1000)
viewer = ParamViewer(reduce_4)
dom_20 = ConstructDomain(DomainStart=0, DomainEnd=number_slider_7)
subtraction_5 = Subtraction(A=number_slider_11, B=Slider(6, range=0..10))
series_2 = Series(Start=number_slider_13, Step=number_slider_13, Count=number_slider_12)
range_5 = Range(Domain=dom_20, Steps=number_slider_7)
series_3 = Series(Start=number_slider_14, Step=number_slider_14, Count=10)
subtraction_6 = Subtraction(A=number_slider_7, B=Slider(6, range=0..10))
dom_21 = ConstructDomain(DomainStart=0, DomainEnd=number_slider_6)
X_7 = UnitX(Factor=series_2)
path_mapper_3 = PathMapper(reduce_3, source="{A;B}", target="{A}")
X_8 = UnitX(Factor=series_3)
number_slider_15 = Slider(70, range=0..1000)
move_22 = Move(Geometry=simplify(path_mapper), Motion=graft(X_7))  # -> simplify(Geometry), Transform
range_6 = Range(Domain=dom_21, Steps=number_slider_6)
move_23 = Move(Geometry=simplify(path_mapper_2), Motion=graft(X_8))  # -> simplify(Geometry), Transform
subtraction_7 = Subtraction(A=number_slider_6, B=Slider(6, range=0..10))
series_4 = Series(Start=number_slider_15, Step=number_slider_15, Count=number_slider_6)
dom_22 = ConstructDomain(DomainStart=Slider(0, range=0..100), DomainEnd=number_slider_9)
path_mapper_4 = PathMapper(reduce_4, source="{A;B}", target="{A}")
panel_14 = Panel(move_22.Geometry)
panel_15 = Panel(move_23.Geometry)
number_slider_16 = Slider(70, range=0..1000)
X_9 = UnitX(Factor=series_4)
reduce_5 = RandomReduce(List=ln_2, Reduction=subtraction_6, Seed=range_5)  # -> simplify(List)
range_7 = Range(Domain=dom_22, Steps=number_slider_9)
viewer_2 = ParamViewer(reduce_3)
move_24 = Move(Geometry=simplify(reduce_3), Motion=graft(X_9))  # -> simplify(Geometry), Transform
series_5 = Series(Start=number_slider_16, Step=number_slider_16, Count=number_slider_7)
reduce_6 = RandomReduce(List=ellipse_5.Ellipse, Reduction=subtraction_5, Seed=range_7)  # -> simplify(List)
reduce_7 = RandomReduce(List=ln_4, Reduction=subtraction_7, Seed=range_6)  # -> simplify(List)
X_10 = UnitX(Factor=series_5)
srfsplit_3 = SurfaceSplit(Surface=reduce_6, Curves=ln_5)
panel_16 = Panel(move_24.Geometry)
move_25 = Move(Geometry=simplify(reduce_4), Motion=graft(X_10))  # -> simplify(Geometry), Transform
split_3 = SplitTree(Data=srfsplit_3, Masks=flatten("{0;0;1,2,...;0}"))  # -> Positive, Negative
number_slider_17 = Slider(2.5, range=0..100)
item_3 = ListItem(List=split_3.Negative, Index=Slider(1, range=0..1), Wrap=True)  # -> simplify(Item)
panel_18 = Panel(move_25.Geometry)
number_slider_18 = Slider(70, range=0..1000)
pt = Point(Point(2022.287336, 935.2089281, 0))
path_mapper_5 = PathMapper(item_3, source="{A;B}", target="{A}")
number_slider_19 = Slider(50, range=0..1000)
series_6 = Series(Start=Slider(0.394, range=0..100), Step=Slider(0.35, range=0..100), Count=Slider(5, range=0..10))  # -> simplify(Series)
series_7 = Series(Start=Slider(1, range=0..10), Step=Slider(0.989, range=0..100), Count=Slider(10, range=0..10))  # -> simplify(Series)
pl = ConstructPlane(Origin=pt, XAxis=Vector(1, 0, 0), YAxis=Vector(0, 1, 0))
number_slider_20 = Slider(70, range=0..1000)
series_8 = Series(Start=number_slider_18, Step=number_slider_18, Count=number_slider_7)
X_11 = UnitX(Factor=series_8)
ellipse_6 = Ellipse(Plane=pl, Radius1=graft(series_6), Radius2=graft(series_7))  # -> Ellipse, Focus1, Focus2
series_9 = Series(Start=number_slider_19, Step=number_slider_19, Count=Slider(70, range=0..1000))
series_10 = Series(Start=number_slider_20, Step=number_slider_20, Count=number_slider_6)
move_26 = Move(Geometry=simplify(reduce_5), Motion=graft(X_11))  # -> simplify(Geometry), Transform
X_12 = UnitX(Factor=series_9)
series_11 = Series(Start=Slider(0, range=0..10), Step=Slider(36, range=0..100), Count=Slider(10, range=0..10))
X_13 = UnitX(Factor=series_10)
move_27 = Move(Geometry=simplify(path_mapper_5), Motion=graft(X_12))  # -> simplify(Geometry), Transform
panel_19 = Panel(move_26.Geometry)
rad = Radians(Degrees=series_11)
move_28 = Move(Geometry=simplify(reduce_7), Motion=graft(X_13))  # -> simplify(Geometry), Transform
panel_20 = Panel(move_27.Geometry)
rotate = Rotate(Geometry=ellipse_6.Ellipse, Angle=graft(rad), Plane=pl)  # -> Geometry, Transform
panel_21 = Panel(move_28.Geometry)
scale = Scale(Center=Point(0, 0, 0), Factor=0.5)  # -> Geometry, Transform
number_slider_21 = Slider(50, range=0..1000)
series_12 = Series(Start=Slider(0, range=0..10), Step=Slider(70, range=0..100), Count=Slider(10, range=0..10))
X_14 = UnitX(Factor=series_12)
series_13 = Series(Start=number_slider_21, Step=number_slider_21, Count=Slider(70, range=0..100))
move_29 = Move(Geometry=simplify(rotate.Geometry), Motion=graft(X_14))  # -> Geometry, Transform
X_15 = UnitX(Factor=series_13)
move_30 = Move(Motion=X_15)  # -> Geometry, Transform
