# Grasshopper definition bookshelf_attempt.gh (Grasshopper 0.9.75)

number_slider = Slider(0, range=0..20)
number_slider_2 = Slider(0, range=0..20)
number_slider_3 = Slider(0, range=0..20)
panel = Panel("shelf geometry")
number_slider_4 = Slider(0, range=0..20)
number_slider_5 = Slider(0, range=0..20)
number_slider_6 = Slider(0, range=0..20)
number_slider_7 = Slider(0, range=0..20)
number_slider_8 = Slider(0, range=0..20)
srf = Surface(<surface referenced from the Rhino model>)
brep = Brep()
number_slider_9 = Slider(0, range=0..20)
panel_2 = Panel("parametrize surface_0")
sdivide = DivideSurface(Surface=srf, UCount=Slider(3, range=0..20), VCount=Slider(72, range=0..72))  # -> Points, Normals, Parameters
volume = Volume()  # -> Volume, Centroid
vec2pt = Vector2Pt(PointA=volume.Centroid, PointB=sdivide.Points, Unitize=False)  # -> Vector, Length
panel_3 = Panel("surface_0 solid")
brep_2 = Brep()
panel_4 = Panel("randomize data tree")
move = Move(Motion=vec2pt.Vector)  # -> flatten(Geometry), Transform
sdiff = SolidDifference(BrepsB=move.Geometry)
