# Grasshopper definition shelves_grasshopper.gh (Grasshopper 0.9.75)

ellipse = Ellipse(Plane=PlaneXY(0, 0, 0), Radius1=Slider(0, range=0..300), Radius2=Slider(0, range=0..300))  # -> Ellipse, Focus1, Focus2
crv = Curve(<curve referenced from the Rhino model>)
number_slider = Slider(0, range=0..300)
boundary = BoundarySurfaces(Edges=crv)
popgeo = PopulateGeometry(Geometry=boundary, Count=100, Seed=1)
