# Grasshopper definition shelving_design1.gh (Grasshopper 0.9.75)

number_slider = Slider(10, range=0..100)
number_slider_2 = Slider(23, range=0..100)
dom = ConstructDomain(DomainStart=Slider(1, range=0..1), DomainEnd=Slider(3.612, range=0..5))
number_slider_3 = Slider(0.25, range=0..1)
random = Random(Range=dom, Number=Slider(2, range=0..100), Seed=2)  # -> simplify(graft(Random))
panel = Panel(random)
movetoplane = MoveToPlane(Plane=PlaneXY(0, 0, 0), Above=True, Below=True)  # -> Geometry, Transform
pl = ConstructPlane(Origin=Point(0, 0, 0), XAxis=Vector(1, 0, 0), YAxis=Vector(0, 1, 0))
crv = Curve(<curve referenced from the Rhino model>)
divide = DivideCurve(Curve=crv, Count=10, Kinks=False)  # -> Points, Tangents, Parameters
plfit = PlaneFit(Points=divide.Points)  # -> Plane, Deviation
ellipse = Ellipse(Plane=plfit.Plane, Radius1=random, Radius2=random)  # -> Ellipse, Focus1, Focus2
max = Maximum()
boundary = BoundarySurfaces(Edges=crv)
popgeo = PopulateGeometry(Geometry=boundary, Count=100, Seed=1)
area = Area(Geometry=ellipse.Ellipse)  # -> Area, Centroid
pdecon = Deconstruct(Point=popgeo)  # -> XComponent, YComponent, ZComponent
vec = VectorXYZ(XComponent=pdecon.XComponent, YComponent=pdecon.YComponent, ZComponent=pdecon.ZComponent)  # -> Vector, Length
move = Move(Geometry=area.Centroid, Motion=vec.Vector)  # -> Geometry, Transform
