# Grasshopper definition wafflestructuremodified2.gh (Grasshopper 0.6.59)

vertical_ribs = Slider(15, range=1..20)  # disabled
# Layout Sections on Reference Planes to be cut
material_thickness = Slider(0.25, range=0..10)  # disabled
# Bug_Report: Definition starts to fail at different points if the material thickness gets to small.
# Current reference drawing Units are set to feet
horizontal_ribs = Slider(10, range=1..80)  # disabled

# ---- group: BaseGeometry
# WaffleStructure: Defintion for slicing solid BREP Rhino object into planes, notching them to fit together then laying them out for cutting.
# 
# Currently only works with closed, solid brep.
# CAH 7/16/2009
geo = Geometry(<19, culture=neutral, publickeytoken=null referenced from the Rhino model>)  # disabled

# ----
bbox = BoundingBox(C=geo, U=False)  # disabled
f_x = F1(F="x+1", x=vertical_ribs)  # disabled
f_x_2 = F1(F="x+1", x=horizontal_ribs)  # disabled
box_corners = BoxCorners(B=bbox)  # -> A, B, C, D, E, F, G, H; disabled
# Layout Sheets: Planes, referencend in from Rhino,  to hold the cut structures.
y_pieces = Surface(<surface referenced from the Rhino model>)  # disabled
# Apply Labels to individual Struts to ID for assembly
xpieces = Surface(<surface referenced from the Rhino model>)  # disabled
ln = Line(A=box_corners.B, B=box_corners.C)  # disabled
ln_2 = Line(A=box_corners.A, B=box_corners.D)  # disabled
ln_3 = Line(A=box_corners.A, B=box_corners.B)  # disabled
ln_4 = Line(A=box_corners.D, B=box_corners.C)  # disabled
divide = DivideCurve(C=ln_3, N=f_x_2, K=False)  # -> P, T, t; disabled
divide_2 = DivideCurve(C=ln_4, N=f_x_2, K=False)  # -> P, T, t; disabled
divide_3 = DivideCurve(C=ln, N=f_x, K=False)  # -> P, T, t; disabled
divide_4 = DivideCurve(C=ln_2, N=f_x, K=False)  # -> P, T, t; disabled
f_x_3 = F1(F="Sqrt(x)", x=horizontal_ribs)  # disabled
f_x_4 = F1(F="Sqrt(x)", x=vertical_ribs)  # disabled
ln_5 = Line(A=divide.P, B=divide_2.P)  # disabled
ln_6 = Line(A=divide_3.P, B=divide_4.P)  # disabled
frames = SurfaceFramesOBSOLETE(S=xpieces, U=f_x_4, V=f_x_4)  # -> F, uv; disabled
frames_2 = SurfaceFramesOBSOLETE(S=y_pieces, U=f_x_3, V=f_x_3)  # -> F, uv; disabled
dist = Distance(A=box_corners.A, B=box_corners.E)  # disabled
lng = ListLength(L=ln_5)  # disabled
lng_2 = ListLength(L=ln_6)  # disabled
f_x_5 = F1(F="x-2", x=lng)  # disabled
f_x_6 = F1(F="x-2", x=lng_2)  # disabled
series = Series(S=1, N=1, C=f_x_5)  # disabled
series_2 = Series(S=1, N=1, C=f_x_6)  # disabled
item = ListItem(L=ln_5, i=series, W=False)  # disabled
item_2 = ListItem(L=ln_6, i=series_2, W=False)  # disabled
Z = UnitZ(F=dist)  # disabled
extr = Extrude(B=item, D=Z)  # disabled
extr_2 = Extrude(B=item_2, D=Z)  # disabled
receiver = Receiver(material_thickness, DrawTag=True, DrawWires=1)  # disabled
sec = BRepPlane(B=geo, P=extr)  # -> C, P; disabled
sec_2 = BRepPlane(B=geo, P=extr_2)  # -> C, P; disabled
f_x_7 = F1(F="-x/2", x=receiver)  # disabled
receiver_2 = Receiver(material_thickness, DrawTag=True, DrawWires=1)  # disabled
receiver_3 = Receiver(material_thickness, DrawTag=True, DrawWires=1)  # disabled
planar = PlanarSrf(E=sec.C)  # disabled
planar_2 = PlanarSrf(E=sec_2.C)  # disabled
X = UnitX(F=f_x_7)  # disabled
Y = UnitY(F=f_x_7)  # disabled
X_2 = UnitX(F=receiver_2)  # disabled
Y_2 = UnitY(F=receiver_3)  # disabled
move = Move(G=planar, T=X)  # disabled
move_2 = Move(G=planar_2, T=Y)  # disabled
extr_3 = Extrude(B=move, D=X_2)  # disabled
extr_4 = Extrude(B=move_2, D=Y_2)  # disabled
sint = SolidIntersection(A=flatten(extr_3), B=extr_4)  # disabled
bbox_2 = BoundingBox(C=sint, U=False)  # disabled
box_corners_2 = BoxCorners(B=bbox_2)  # -> A, B, C, D, E, F, G, H; disabled
dist_2 = Distance(A=box_corners_2.A, B=box_corners_2.E)  # disabled
f_x_8 = F1(F="x/2", x=dist_2)  # disabled
f_x_9 = F1(F="-x/2", x=dist_2)  # disabled
Z_2 = UnitZ(F=f_x_9)  # disabled
Z_3 = UnitZ(F=f_x_8)  # disabled
move_3 = Move(G=bbox_2, T=Z_2)  # disabled
move_4 = Move(G=bbox_2, T=Z_3)  # disabled
sdiff = SolidDifference(A=extr_3, B=flatten(move_3))  # disabled
sdiff_2 = SolidDifference(A=extr_4, B=flatten(move_4))  # disabled

# ---- group: RefPlanes_Y
receiver_4 = Receiver(planar, DrawTag=True, DrawWires=1)  # disabled

# ---- group: RefPlanes_X
receiver_5 = Receiver(planar_2, DrawTag=True, DrawWires=1)  # disabled

# ----
digfaby = Orient(G=flatten(sdiff), A=flatten(receiver_4), B=flatten(frames_2.F), DataComparison="shortest_list")  # disabled
digfabx = Orient(G=flatten(sdiff_2), A=flatten(receiver_5), B=flatten(frames.F), DataComparison="shortest_list")  # disabled
slider = Slider(-5.000152588, range=-25..25)  # disabled
slider_2 = Slider(-4.531402588, range=-25..25)  # disabled
area = BRepArea(B=digfaby)  # -> A, C; disabled
area_2 = BRepArea(B=digfabx)  # -> A, C; disabled
pcomp = Decompose(P=area.C)  # -> X, Y, Z; disabled
pcomp_2 = Decompose(P=area_2.C)  # -> X, Y, Z; disabled
add = Addition(A=pcomp.Y, B=slider)  # disabled
add_2 = Addition(A=pcomp_2.Y, B=slider_2)  # disabled
# Note: Area component used to get the centroid of each strut.  Will be used as the anchor point for text labels in next step.
# (just moving the labels off of the struts, away from centroid on the Y axis).
pt = PointXYZ(X=pcomp.X, Y=add, Z=pcomp.Z)  # disabled
pt_2 = PointXYZ(X=pcomp_2.X, Y=add_2, Z=pcomp_2.Z)  # disabled

# ---- group: Labels
series_3 = Series(S=1, N=1, C=vertical_ribs)  # disabled
series_4 = Series(S=1, N=1, C=horizontal_ribs)  # disabled
strucx = String("StrucX")  # disabled
strucy = String("StrucY")  # disabled
f_x_y = F2(F="x&y", x=strucy, y=series_3)  # disabled
f_x_y_2 = F2(F="x&y", x=strucx, y=series_4)  # disabled
receiver_6 = Receiver(pt, DrawTag=True, DrawWires=1)  # disabled
receiver_7 = Receiver(pt_2, DrawTag=True, DrawWires=1)  # disabled
strucy_2 = TextTag3D(L=receiver_7, T=f_x_y, S=1)  # disabled
strucx_2 = TextTag3D(L=receiver_6, T=f_x_y_2, S=1)  # disabled
