# Grasshopper definition wafflestructuremodified2.ghx (Grasshopper 0.7.35)

vertical_ribs = Slider(15, range=1..20)
# Layout Sections on Reference Planes to be cut
material_thickness = Slider(1, range=0..10)
# Bug_Report: Definition starts to fail at different points if the material thickness gets to small.
# Current reference drawing Units are set to feet
horizontal_ribs = Slider(17.98499699, range=1..80)

# ---- group: BaseGeometry
# WaffleStructure: Defintion for slicing solid BREP Rhino object into planes, notching them to fit together then laying them out for cutting.
# 
# Currently only works with closed, solid brep.
# CAH 7/16/2009
geo = Geometry(<20, culture=neutral, publickeytoken=null referenced from the Rhino model>)

# ----
bbox = BoundingBox(Content=geo, Union=False)
f_x = F1(Function="x+1", X=vertical_ribs)
f_x_2 = F1(Function="x+1", X=horizontal_ribs)
box_corners = BoxCorners(Box=bbox)  # -> CornerA, CornerB, CornerC, CornerD, CornerE, CornerF, CornerG, CornerH
# Layout Sheets: Planes, referencend in from Rhino,  to hold the cut structures.
y_pieces = Surface(<surface referenced from the Rhino model>)
# Apply Labels to individual Struts to ID for assembly
xpieces = Surface(<surface referenced from the Rhino model>)
ln = Line(PointA=box_corners.CornerB, PointB=box_corners.CornerC)
ln_2 = Line(PointA=box_corners.CornerA, PointB=box_corners.CornerD)
ln_3 = Line(PointA=box_corners.CornerA, PointB=box_corners.CornerB)
ln_4 = Line(PointA=box_corners.CornerD, PointB=box_corners.CornerC)
divide = DivideCurve(Curve=ln_3, Number=f_x_2, Kinks=False)  # -> Points, Tangents, Parameters
divide_2 = DivideCurve(Curve=ln_4, Number=f_x_2, Kinks=False)  # -> Points, Tangents, Parameters
divide_3 = DivideCurve(Curve=ln, Number=f_x, Kinks=False)  # -> Points, Tangents, Parameters
divide_4 = DivideCurve(Curve=ln_2, Number=f_x, Kinks=False)  # -> Points, Tangents, Parameters
f_x_3 = F1(Function="Sqrt(x)", X=horizontal_ribs)
f_x_4 = F1(Function="Sqrt(x)", X=vertical_ribs)
ln_5 = Line(PointA=divide.Points, PointB=divide_2.Points)
ln_6 = Line(PointA=divide_3.Points, PointB=divide_4.Points)
frames = SurfaceFramesOBSOLETE(Surface=xpieces, UCount=f_x_4, VCount=f_x_4)  # -> Frames, Parameters
frames_2 = SurfaceFramesOBSOLETE(Surface=y_pieces, UCount=f_x_3, VCount=f_x_3)  # -> Frames, Parameters
dist = Distance(PointA=box_corners.CornerA, PointB=box_corners.CornerE)
lng = ListLength(List=ln_5)
lng_2 = ListLength(List=ln_6)
f_x_5 = F1(Function="x-2", X=lng)
f_x_6 = F1(Function="x-2", X=lng_2)
series = Series(Start=1, Step=1, Count=f_x_5)
series_2 = Series(Start=1, Step=1, Count=f_x_6)
item = ListItem(List=ln_5, Index=series, Wrap=False)
item_2 = ListItem(List=ln_6, Index=series_2, Wrap=False)
Z = UnitZ(Factor=dist)
extr = Extrude(Base=item, Direction=Z)
extr_2 = Extrude(Base=item_2, Direction=Z)
receiver = Receiver(material_thickness, DrawTag=True, DrawWires=1)  # disabled
sec = BRepPlane(BRep=geo, Plane=extr)  # -> Curves, Points
sec_2 = BRepPlane(BRep=geo, Plane=extr_2)  # -> Curves, Points
f_x_7 = F1(Function="-x/2", X=material_thickness)
receiver_2 = Receiver(material_thickness, DrawTag=True, DrawWires=1)  # disabled
receiver_3 = Receiver(material_thickness, DrawTag=True, DrawWires=1)  # disabled
planar = PlanarSrf(Edges=sec.Curves)
planar_2 = PlanarSrf(Edges=sec_2.Curves)
X = UnitX(Factor=f_x_7)
Y = UnitY(Factor=f_x_7)
X_2 = UnitX(Factor=material_thickness)
Y_2 = UnitY(Factor=material_thickness)
move = Move(Geometry=planar, Translation=X)
move_2 = Move(Geometry=planar_2, Translation=Y)
extr_3 = Extrude(Base=move, Direction=X_2)
extr_4 = Extrude(Base=move_2, Direction=Y_2)
sint = SolidIntersection(FirstSet=flatten(extr_3), SecondSet=extr_4)
bbox_2 = BoundingBox(Content=sint, Union=False)
box_corners_2 = BoxCorners(Box=bbox_2)  # -> CornerA, CornerB, CornerC, CornerD, CornerE, CornerF, CornerG, CornerH
dist_2 = Distance(PointA=box_corners_2.CornerA, PointB=box_corners_2.CornerE)
f_x_8 = F1(Function="x/2", X=dist_2)
f_x_9 = F1(Function="-x/2", X=dist_2)
Z_2 = UnitZ(Factor=f_x_9)
Z_3 = UnitZ(Factor=f_x_8)
move_3 = Move(Geometry=bbox_2, Translation=Z_2)
move_4 = Move(Geometry=bbox_2, Translation=Z_3)

# ---- group: RefPlanes_X
receiver_4 = Receiver(planar_2, DrawTag=True, DrawWires=1)  # disabled

# ---- group: RefPlanes_Y
receiver_5 = Receiver(planar, DrawTag=True, DrawWires=1)  # disabled

# ----
sdiff = SolidDifference(FirstSet=extr_3, SecondSet=flatten(move_3))
sdiff_2 = SolidDifference(FirstSet=extr_4, SecondSet=flatten(move_4))
digfaby = Orient(Geometry=flatten(sdiff), Initial=flatten(planar), Final=flatten(frames_2.Frames), DataComparison="shortest_list")
digfabx = Orient(Geometry=flatten(sdiff_2), Initial=flatten(planar_2), Final=flatten(frames.Frames), DataComparison="shortest_list")
area = BRepArea(BRep=digfaby)  # -> Area, Centroid
area_2 = BRepArea(BRep=digfabx)  # -> Area, Centroid
pcomp = Decompose(Point=area.Centroid)  # -> XComponent, YComponent, ZComponent
pcomp_2 = Decompose(Point=area_2.Centroid)  # -> XComponent, YComponent, ZComponent
add = Addition(FirstNumber=pcomp.YComponent, SecondNumber=Slider(0, range=-25..25))
add_2 = Addition(FirstNumber=pcomp_2.YComponent, SecondNumber=Slider(-1.25, range=-25..25))
# Note: Area component used to get the centroid of each strut.  Will be used as the anchor point for text labels in next step.
# (just moving the labels off of the struts, away from centroid on the Y axis).
pt = PointXYZ(XComponent=pcomp.XComponent, YComponent=add, ZComponent=pcomp.ZComponent)
pt_2 = PointXYZ(XComponent=pcomp_2.XComponent, YComponent=add_2, ZComponent=pcomp_2.ZComponent)

# ---- group: Labels
series_3 = Series(Start=1, Step=1, Count=vertical_ribs)
series_4 = Series(Start=1, Step=1, Count=horizontal_ribs)
strucy = String("StrucY")
strucx = String("StrucX")
f_x_y = F2(Function="x&y", X=strucy, Y=series_3)
f_x_y_2 = F2(Function="x&y", X=strucx, Y=series_4)
receiver_6 = Receiver(pt_2, DrawTag=True, DrawWires=1)  # disabled
receiver_7 = Receiver(pt, DrawTag=True, DrawWires=1)  # disabled
strucy_2 = TextTag3D(Location=pt_2, Text=f_x_y, Size=1)
strucx_2 = TextTag3D(Location=pt, Text=f_x_y_2, Size=1)
